# Grasshopper definition parametric_remapping.ghx (Grasshopper 1.0.7)

# ----
# CREATE GRID OF RECTAGLES/SQUARES
number_slider = Slider(50, range=0..100)
pt = Point(<point referenced from the Rhino model>)
xy = XYPlane(Origin=pt)
recgrid = Rectangular(Plane=xy, SizeX=1, SizeY=1, ExtentX=number_slider, ExtentY=Slider(50, range=0..100))  # -> Cells, Points

# ----
# CREATE GRID OF RECTAGLES/SQUARES
number_slider_2 = Slider(5, range=0..100)
pt_2 = Point(<point referenced from the Rhino model>)
xy_2 = XYPlane(Origin=pt_2)
recgrid_2 = Rectangular(Plane=xy_2, SizeX=1, SizeY=1, ExtentX=number_slider_2, ExtentY=Slider(5, range=0..100))  # -> Cells, Points

# ----
# CENTER OF SHAPES
flatten = FlattenTree(Tree=recgrid.Cells, Path="{0}")
area = Area(Geometry=flatten)  # -> Area, Centroid

# ----
# CIRCLES ON CENTERS
number_slider_3 = Slider(0.5, range=0..1)
circle = CircleCNR(Center=area.Centroid, Normal=Vector(0, 0, 1), Radius=number_slider_3)

# ----
# CENTER OF SHAPES
flatten_2 = FlattenTree(Tree=recgrid_2.Cells, Path="{0}")
area_2 = Area(Geometry=flatten_2)  # -> Area, Centroid

# ----
# CIRCLES ON CENTERS
number_slider_4 = Slider(0.5, range=0..1)
circle_2 = CircleCNR(Center=area_2.Centroid, Normal=Vector(0, 0, 1), Radius=number_slider_4)

# ----
# POINT 1
# DIST TO ATTRACTOR POINT
pt_3 = Point(<point referenced from the Rhino model>)
dist = Distance(PointA=circle, PointB=pt_3)

# ----
# POINT 2
pt_4 = Point(<point referenced from the Rhino model>)
dist_2 = Distance(PointA=pt_4, PointB=circle)

Z = UnitZ(Factor=Slider(12, range=1..15))
colour = ColourPicker(PickedColour=RGB(181, 181, 181))
colour_2 = ColourPicker(PickedColour=RGB(181, 181, 181))
colour_3 = ColourPicker(PickedColour=RGB(255, 0, 0))
colour_4 = ColourPicker(PickedColour=RGB(255, 255, 255))

# ----
# REMAP DIST TO DESIRED RANGE OF VALUES
number_slider_5 = Slider(0.1, range=0..0.1)
dom = ConstructDomain(DomainStart=number_slider_5, DomainEnd=Slider(1, range=0..1))

# ----
# POINT AND CURVE DEFINITION
min = Minimum(A=dist, B=dist_2)
crv = Curve(<curve referenced from the Rhino model>)
crv_cp = CurveClosestPoint(Point=circle, Curve=crv)  # -> Point, Parameter, Distance
min_2 = Minimum(A=min, B=crv_cp.Distance)

bnd = Bounds(Numbers=crv_cp.Distance)
remap = RemapNumbers(Value=min_2, Source=bnd, Target=dom)  # -> Mapped, Clipped

scale = Scale(Geometry=circle, Center=area.Centroid, Factor=remap.Mapped)  # -> Geometry, Transform

# ----
# POINT MOVING ALONG CURVE
crv_2 = Curve(<curve referenced from the Rhino model>)

move = Move(Geometry=crv_2, Motion=Z)  # -> Geometry, Transform

eval = EvaluateCurve(Curve=reparameterize(move.Geometry), Parameter=Slider(0, range=0..1))  # -> Point, Tangent, Angle

preview = CustomPreview(Geometry=move.Geometry, Material=colour)
ln = Line(StartPoint=circle_2, EndPoint=eval.Point)
dist_3 = Distance(PointA=eval.Point, PointB=circle_2)

# ----
# REMAP DIST TO DESIRED RANGE OF VALUES
number_slider_6 = Slider(0.1, range=0..0.1)
bnd_2 = Bounds(Numbers=dist_3)
dom_2 = ConstructDomain(DomainStart=number_slider_6, DomainEnd=Slider(1, range=0..1))
remap_2 = RemapNumbers(Value=dist_3, Source=bnd_2, Target=dom_2)  # -> Mapped, Clipped

# ----
# REMAP DIST TO DESIRED RANGE OF VALUES
number_slider_7 = Slider(0, range=0..10)
bnd_3 = Bounds(Numbers=dist_3)
dom_3 = ConstructDomain(DomainStart=number_slider_7, DomainEnd=Slider(6, range=0..10))
remap_3 = RemapNumbers(Value=dist_3, Source=bnd_3, Target=dom_3)  # -> Mapped, Clipped

preview_2 = CustomPreview(Geometry=ln, Material=colour_2)
preview_3 = CustomPreview(Geometry=eval.Point, Material=colour_3)
Z_2 = UnitZ(Factor=remap_3.Mapped)

# ----
# POINT AND CURVE DEFINITION
scale_2 = Scale(Geometry=circle_2, Center=area_2.Centroid, Factor=remap_2.Mapped)  # -> Geometry, Transform

move_2 = Move(Geometry=scale_2.Geometry, Motion=Z_2)  # -> Geometry, Transform
graft = GraftTree(Tree=scale_2.Geometry, IncludeEmptyLists=True, IncludeNullItems=True)
graft_2 = GraftTree(Tree=move_2.Geometry, IncludeEmptyLists=True, IncludeNullItems=True)
loft = Loft(
    Curves=[graft, graft_2],
    Options={Adjust=False, Closed=False, LoftEnds=0, LoftSimp=0, LoftType=0, Rebuild=10, Refit=0.01})
preview_4 = CustomPreview(Geometry=loft, Material=colour_4)
