# Grasshopper definition lego_bridge_aggregation.ghx (Grasshopper 1.0.7)

geo = Geometry(<brep referenced from the Rhino model>)
pt = Point([<point referenced from the Rhino model> x2])
crv = Curve([<curve referenced from the Rhino model> x2])
geo_2 = Geometry(<brep referenced from the Rhino model>)
pt_2 = Point([<point referenced from the Rhino model> x2])
crv_2 = Curve([<curve referenced from the Rhino model> x2])
points = PointList(Points=pt, Size=Slider(0.25, range=0.25..1))
points_2 = PointList(Points=pt_2, Size=Slider(0.25, range=0.25..1))
mesh = MeshBrep(
    Brep=geo,
    Settings={GridMaxCount=0, GridMinCount=16, JaggedSeams=False, MaxEdgeLength=0, MinEdgeLength=0.0001, MinTolerance=0, Refine=True, RefineAngle=0, RelativeTolerance=0.65, SimplePlanes=True, Tolerance=0})
mesh_2 = MeshBrep(
    Brep=geo_2,
    Settings={GridMaxCount=0, GridMinCount=16, JaggedSeams=False, MaxEdgeLength=0, MinEdgeLength=0.0001, MinTolerance=0, Refine=True, RefineAngle=0, RelativeTolerance=0.65, SimplePlanes=True, Tolerance=0})
conndir = Wasp_ConnectionFromDirection(GEO=mesh, CEN=pt, UP=crv)  # -> CONN, PLN_OUT; inputs CEN: list of Point3d, UP: list of Curve, T: list; plug-in component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
conndir_2 = Wasp_ConnectionFromDirection(GEO=mesh_2, CEN=pt_2, UP=crv_2)  # -> CONN, PLN_OUT; inputs CEN: list of Point3d, UP: list of Curve, T: list; plug-in component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
part = Wasp_BasicPart(NAME="LEGO 1", GEO=mesh, CONN=flatten(conndir.CONN))  # -> PART; inputs GEO: Mesh, CONN: list, ATTR: list; plug-in component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
part_2 = Wasp_BasicPart(NAME="LEGO 2", GEO=mesh_2, CONN=flatten(conndir_2.CONN))  # -> PART; inputs GEO: Mesh, CONN: list, ATTR: list; plug-in component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
merge = Merge(Data1=part, Data2=part_2)
rule = Wasp_Rule(P1="LEGO 1", C1=Slider(1, range=0..100), P2="LEGO 2", C2=Slider(1, range=0..100))  # -> R; inputs C1: Int32, C2: Int32; plug-in component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
rule_2 = Wasp_Rule(P1="LEGO 1", C1=Slider(0, range=0..100), P2="LEGO 2", C2=Slider(0, range=0..100))  # -> R; inputs C1: Int32, C2: Int32; plug-in component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
stochasticaggregation = Wasp_StochasticAggregation(PART=flatten(merge), N=Slider(50, range=0..1000), RULES=[rule_2, rule], RESET=Button())  # -> AGGR, PART_OUT; inputs PART: list, PREV: list, N: Int32, RULES: list, SEED: Int32, MODE: Int32, GC: list, RESET: Boolean; plug-in component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
partgeo = Wasp_GetPartGeometry(PART=stochasticaggregation.PART_OUT)  # -> GEO; plug-in component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
