# Grasshopper definition nervi_dome.ghx (Grasshopper 1.0.7)
# plug-ins: Bifocals

# ----
# MAIN COLUMNS
number_slider = Slider(39, range=0..100)
xy = XYPlane(Origin=Point(0, 0, 0))
xy_2 = XYPlane(Origin=Point(0, 0, 0))
circle = CircleCNR(Center=xy, Normal=Vector(0, 0, 1), Radius=number_slider)
circle_2 = CircleCNR(Center=xy_2, Normal=Vector(0, 0, 1), Radius=Slider(35, range=0..100))
neg = Negative(Value=Slider(6, range=0..10))
neg_2 = Negative(Value=Slider(3, range=0..10))
Z = UnitZ(Factor=neg)
Z_2 = UnitZ(Factor=neg_2)
number_slider_2 = Slider(36, range=0..100)
move = Move(Geometry=circle, Motion=Z)  # -> Geometry, Transform
move_2 = Move(Geometry=circle_2, Motion=Z_2)  # -> Geometry, Transform
divide = DivideCurve(Curve=move.Geometry, Count=number_slider_2, Kinks=False)  # -> Points, Tangents, Parameters
divide_2 = DivideCurve(Curve=move_2.Geometry, Count=number_slider_2, Kinks=False)  # -> Points, Tangents, Parameters
ln = Line(StartPoint=divide.Points, EndPoint=divide_2.Points)

# ----
# V COMPONENTS
number_slider_3 = Slider(1, range=0..1)
xy_3 = XYPlane(Origin=Point(0, 0, 0))
neg_3 = Negative(Value=number_slider_3)
circle_3 = CircleCNR(Center=xy_3, Normal=Vector(0, 0, 1), Radius=Slider(32, range=0..100))
Z_3 = UnitZ(Factor=neg_3)
move_3 = Move(Geometry=circle_3, Motion=Z_3)  # -> Geometry, Transform
divide_3 = DivideCurve(Curve=move_3.Geometry, Count=Slider(72, range=0..100), Kinks=False)  # -> Points, Tangents, Parameters
item = ListItem(List=divide_3.Points, Index=0, Wrap=True)  # -> Item1, Item, Item1_2
item_2 = ListItem(List=divide_2.Points, Index=0, Wrap=True)

# ----
# MAIN DOME
# CREATE MAIN CIRLES
number_slider_4 = Slider(30, range=0..100)
xy_4 = XYPlane(Origin=Point(0, 0, 0))
xy_5 = XYPlane(Origin=Point(0, 0, 0))
xy_6 = XYPlane(Origin=Point(0, 0, 0))
circle_4 = CircleCNR(Center=xy_4, Normal=Vector(0, 0, 1), Radius=number_slider_4)
circle_5 = CircleCNR(Center=xy_5, Normal=Vector(0, 0, 1), Radius=Slider(24, range=0..100))
circle_6 = CircleCNR(Center=xy_6, Normal=Vector(0, 0, 1), Radius=Slider(12, range=0..100))

# ----
# MOVE CIRCLES VERTICALLY
number_slider_5 = Slider(4, range=0..10)
Z_4 = UnitZ(Factor=number_slider_5)
Z_5 = UnitZ(Factor=Slider(8, range=0..10))
move_4 = Move(Geometry=circle_5, Motion=Z_4)  # -> Geometry, Transform
move_5 = Move(Geometry=circle_6, Motion=Z_5)  # -> Geometry, Transform

# ----
# W COMPONENT
number_slider_6 = Slider(108, range=0..1000)
data = Data(circle_4)
divide_4 = DivideCurve(Curve=data, Count=number_slider_6, Kinks=False)  # -> Points, Tangents, Parameters
item_3 = ListItem(List=divide_4.Points, Index=0, Wrap=True)  # -> Item, Item1, Item2, Item3
item_4 = ListItem(List=divide_3.Points, Index=0, Wrap=True)  # -> Item, Item1

number_slider_7 = Slider(108, range=0..1000)
divide_5 = DivideCurve(Curve=move_5.Geometry, Count=number_slider_7, Kinks=False)  # -> Points, Tangents, Parameters

neg_4 = Negative(Value=Slider(8, range=0..10))
offset = OffsetCurve(Curve=move_5.Geometry, Distance=neg_4, Corners=1)
divide_6 = DivideCurve(Curve=offset, Count=number_slider_7, Kinks=False)  # -> Points, Tangents, Parameters

# ----
# CREATE ARC
end = EndPoints(Curve=circle_4)  # -> Start, End
end_2 = EndPoints(Curve=move_4.Geometry)  # -> Start, End
end_3 = EndPoints(Curve=move_5.Geometry)  # -> Start, End
arc = Arc3Pt(PointA=end.Start, PointB=end_2.Start, PointC=end_3.Start)  # -> Arc, Plane, Radius

# ----
# CREATE DOME SURFACE AND SUBDIVIDE
number_slider_8 = Slider(108, range=0..1000)
swp1 = Sweep1(Rail=circle_4, Sections=arc.Arc, Miter=1)
divide_7 = DivideDomain²(Domain=swp1, UCount=number_slider_8, VCount=Slider(11, range=0..100))
subsrf = Isotrim(Surface=swp1, Domain=divide_7)

item_5 = ListItem(List=ln, Index=0, Wrap=True)
ln_2 = Line(StartPoint=item_4.Item1, EndPoint=[item_3.Item, item_3.Item1, item_3.Item2, item_3.Item3])
ln_3 = Line(StartPoint=item_2, EndPoint=[item.Item1, item.Item1_2])

# ----
# TOP DETAIL
ln_4 = Line(StartPoint=divide_5.Points, EndPoint=divide_6.Points)
pipe = Pipe(Curve=ln_4, Radius=Slider(0.1, range=0..0.1), Caps=0)

# ----
# ROTATE/COPY COLUMNS
merge = Merge(Data1=item_5, Data2=ln_3, Data3=ln_2)
series = Series(Start=0, Step=Slider(10, range=0..10), Count=Slider(36, range=0..100))
pipe_2 = Pipe(Curve=merge, Radius=Slider(0.1, range=0..0.1), Caps=0)
rad = Radians(Degrees=series)
rotate = Rotate(Geometry=pipe_2, Angle=rad, Plane=PlaneXY(0, 0, 0))  # -> Geometry, Transform

# ----
# DECONSTRUCT SURFACE + ORGANIZE POINTS FOR EACH SURFACE
debrep = DeconstructBrep(Brep=subsrf)  # -> Faces, Edges, Vertices
item_6 = ListItem(List=debrep.Vertices, Index="0", Wrap=True)
item_7 = ListItem(List=debrep.Vertices, Index="1", Wrap=True)
item_8 = ListItem(List=debrep.Vertices, Index="2", Wrap=True)
item_9 = ListItem(List=debrep.Vertices, Index="3", Wrap=True)

# ----
# CREATE DIAGONAL LINES + GIVE THICKNESS
ln_5 = Line(StartPoint=item_7, EndPoint=item_9)
ln_6 = Line(StartPoint=item_6, EndPoint=item_8)
pipe_3 = Pipe(Curve=[ln_6, ln_5], Radius=Slider(0.1, range=0..0.1), Caps=0)

# ----
# COLOR PREVIEW
swatch = ColourSwatch(SwatchColor=RGB(235, 224, 213))
preview = CustomPreview(Geometry=[pipe_3, pipe, rotate.Geometry], Material=swatch)
