# Grasshopper definition parametric_cup.ghx (Grasshopper 1.0.7)

number_slider = Slider(39, range=0..50)
number_slider_2 = Slider(21, range=0..50)
number_slider_3 = Slider(31, range=0..50)
construct_point = ConstructPoint(XCoordinate=number_slider_2, YCoordinate=number_slider_3, ZCoordinate=number_slider)

number_slider_4 = Slider(21, range=0..50)
number_slider_5 = Slider(29, range=0..50)
number_slider_6 = Slider(33, range=0..50)
construct_point_2 = ConstructPoint(XCoordinate=number_slider_5, YCoordinate=number_slider_6, ZCoordinate=number_slider_4)

number_slider_7 = Slider(30, range=0..50)
number_slider_8 = Slider(29, range=0..50)
number_slider_9 = Slider(0, range=0..50)
construct_point_3 = ConstructPoint(XCoordinate=number_slider_7, YCoordinate=number_slider_8, ZCoordinate=number_slider_9)

construct_point_4 = ConstructPoint(XCoordinate=Slider(40, range=0..50), YCoordinate=Slider(22, range=0..50), ZCoordinate=Slider(0, range=0..50))

construct_point_5 = ConstructPoint(XCoordinate=Slider(29, range=0..50), YCoordinate=Slider(29, range=0..50), ZCoordinate=number_slider)

construct_point_6 = ConstructPoint(XCoordinate=Slider(33, range=0..50), YCoordinate=Slider(13, range=0..50), ZCoordinate=Slider(0, range=0..50))

construct_point_7 = ConstructPoint(XCoordinate=Slider(38, range=0..50), YCoordinate=Slider(23, range=0..50), ZCoordinate=number_slider)

construct_point_8 = ConstructPoint(XCoordinate=Slider(35, range=0..50), YCoordinate=Slider(9, range=0..50), ZCoordinate=number_slider)

construct_point_9 = ConstructPoint(XCoordinate=Slider(32, range=0..50), YCoordinate=Slider(7, range=0..50), ZCoordinate=Slider(0, range=0..50))

construct_point_10 = ConstructPoint(XCoordinate=Slider(20, range=0..50), YCoordinate=Slider(0, range=0..50), ZCoordinate=Slider(0, range=0..50))

construct_point_11 = ConstructPoint(XCoordinate=Slider(24, range=0..50), YCoordinate=Slider(11, range=0..50), ZCoordinate=number_slider)

construct_point_12 = ConstructPoint(XCoordinate=Slider(6, range=0..50), YCoordinate=Slider(10, range=0..50), ZCoordinate=number_slider)

construct_point_13 = ConstructPoint(XCoordinate=Slider(18, range=0..50), YCoordinate=Slider(5, range=0..50), ZCoordinate=Slider(0, range=0..50))

construct_point_14 = ConstructPoint(XCoordinate=Slider(8, range=0..50), YCoordinate=Slider(11, range=0..50), ZCoordinate=Slider(0, range=0..50))

construct_point_15 = ConstructPoint(XCoordinate=Slider(13, range=0..50), YCoordinate=Slider(26, range=0..50), ZCoordinate=Slider(0, range=0..50))

construct_point_16 = ConstructPoint(XCoordinate=Slider(9, range=0..50), YCoordinate=Slider(27, range=0..50), ZCoordinate=number_slider)

construct_point_17 = ConstructPoint(XCoordinate=Slider(13, range=0..50), YCoordinate=Slider(31, range=0..50), ZCoordinate=number_slider)

construct_point_18 = ConstructPoint(XCoordinate=Slider(35, range=0..50), YCoordinate=Slider(30, range=0..50), ZCoordinate=number_slider_4)

construct_point_19 = ConstructPoint(XCoordinate=Slider(35, range=0..50), YCoordinate=Slider(23, range=0..50), ZCoordinate=number_slider_4)

construct_point_20 = ConstructPoint(XCoordinate=Slider(36, range=0..50), YCoordinate=Slider(18, range=0..50), ZCoordinate=number_slider_4)

construct_point_21 = ConstructPoint(XCoordinate=Slider(32, range=0..50), YCoordinate=Slider(14, range=0..50), ZCoordinate=number_slider_4)

construct_point_22 = ConstructPoint(XCoordinate=Slider(12, range=0..50), YCoordinate=Slider(10, range=0..50), ZCoordinate=number_slider_4)

construct_point_23 = ConstructPoint(XCoordinate=Slider(7, range=0..50), YCoordinate=Slider(27, range=0..50), ZCoordinate=number_slider_4)

construct_point_24 = ConstructPoint(XCoordinate=Slider(12, range=0..50), YCoordinate=Slider(30, range=0..50), ZCoordinate=number_slider_4)

construct_point_25 = ConstructPoint(XCoordinate=number_slider_2, YCoordinate=number_slider_3, ZCoordinate=number_slider)
merge = Merge(
    Data1=construct_point,
    Data2=construct_point_5,
    Data3=construct_point_7,
    Data4=construct_point_8,
    Data5=construct_point_11,
    Data6=construct_point_12,
    Data7=construct_point_16,
    Data8=construct_point_17,
    Data9=construct_point_25)
panel = Panel(merge)
interpolate = Interpolate(Vertices=panel, Degree=3, Periodic=False, KnotStyle=1)  # -> Curve, Length, Domain

construct_point_26 = ConstructPoint(XCoordinate=number_slider_7, YCoordinate=number_slider_8, ZCoordinate=number_slider_9)
merge_2 = Merge(
    Data1=construct_point_3,
    Data2=construct_point_4,
    Data3=construct_point_6,
    Data4=construct_point_9,
    Data5=construct_point_10,
    Data6=construct_point_13,
    Data7=construct_point_14,
    Data8=construct_point_15,
    Data9=construct_point_26)
panel_2 = Panel(merge_2)
interpolate_2 = Interpolate(Vertices=panel_2, Degree=3, Periodic=False, KnotStyle=1)  # -> Curve, Length, Domain

construct_point_27 = ConstructPoint(XCoordinate=number_slider_5, YCoordinate=number_slider_6, ZCoordinate=number_slider_4)
merge_3 = Merge(
    Data1=construct_point_2,
    Data2=construct_point_18,
    Data3=construct_point_19,
    Data4=construct_point_20,
    Data5=construct_point_21,
    Data6=construct_point_22,
    Data7=construct_point_23,
    Data8=construct_point_24,
    Data9=construct_point_27)
panel_3 = Panel(merge_3)
interpolate_3 = Interpolate(Vertices=panel_3, Degree=3, Periodic=False, KnotStyle=1)  # -> Curve, Length, Domain

loft = Loft(
    Curves=[interpolate_2.Curve, interpolate_3.Curve, interpolate.Curve],
    Options={Adjust=False, Closed=False, LoftEnds=0, LoftSimp=0, LoftType=0, Rebuild=10, Refit=0.01})
