# Grasshopper definition parametric_stop.ghx (Grasshopper 1.0.7)
# plug-ins: Bifocals

# ----
# CATTY
number_slider = Slider(0.46, range=0..1)
number_slider_2 = Slider(50, range=0..100)
curve = Curve(<curve referenced from the Rhino model>)
curve_2 = Curve(<curve referenced from the Rhino model>)
divide_curve = DivideCurve(Curve=curve_2, Count=number_slider_2, Kinks=False)  # -> Points, Tangents, Parameters
pipe = Pipe(Curve=curve, Radius=Slider(1, range=0..1), Caps=0)
divide_curve_2 = DivideCurve(Curve=curve, Count=number_slider_2, Kinks=False)  # -> Points, Tangents, Parameters
pipe_2 = Pipe(Curve=curve_2, Radius=number_slider, Caps=0)
line = Line(StartPoint=divide_curve.Points, EndPoint=divide_curve_2.Points)
divide_curve_3 = DivideCurve(Curve=line, Count=10, Kinks=False)  # -> Points, Tangents, Parameters
pipe_3 = Pipe(Curve=line, Radius=Slider(0.41, range=0..1), Caps=0)
flip_matrix = FlipMatrix(Data=divide_curve_3.Points)
interpolate = Interpolate(Vertices=flip_matrix, Degree=3, Periodic=False, KnotStyle=1)  # -> Curve, Length, Domain

# ----
# PETE
number_slider_3 = Slider(12, range=0..100)
surface = Surface(<surface referenced from the Rhino model>)
curve_3 = Curve(<curve referenced from the Rhino model>)
multiplication = Multiplication(A=number_slider_3, B="360")
twist = Twist(Geometry=surface, Axis=curve_3, Angle=degrees(multiplication), Infinite=Toggle(True), Rigid=False)
deconstruct_brep = DeconstructBrep(Brep=twist)  # -> Faces, Edges, Vertices
list_item = ListItem(List=deconstruct_brep.Edges, Index=[Slider(3, range=0..3), Slider(1, range=0..3)], Wrap=True)
curve_4 = Curve(<curve referenced from the Rhino model>)
flow = Flow(Geometry=list_item, Base=curve_3, Target=curve_4, ReverseBase=False, ReverseTarget=False, Stretch=True, Rigid=False)  # -> graft(Geometry)
area = Area(Geometry=curve_4)  # -> Area, Centroid
rotate = Rotate(Geometry=flow, Angle=degrees(Slider(3, range=0..100)), Plane=area.Centroid)  # -> Geometry, Transform
loft = Loft(
    Curves=[flow, rotate.Geometry],
    Options={Adjust=False, Closed=False, LoftEnds=0, LoftSimp=0, LoftType=0, Rebuild=10, Refit=0.01})  # -> flatten(Loft)
list_item_2 = ListItem(List=loft, Index=0, Wrap=True)
list_item_3 = ListItem(List=loft, Index="1", Wrap=True)
custom_preview = CustomPreview(Geometry=list_item_3, Material=ColourSwatch(SwatchColor=RGB(255, 255, 255)))
custom_preview_2 = CustomPreview(Geometry=list_item_2, Material=ColourSwatch(SwatchColor=RGB(0, 0, 0)))

# ----
# ASIFA
curve_5 = Curve(<curve referenced from the Rhino model>)
curve_middle = CurveMiddle(Curve=curve_5)
project = Project(Geometry=curve_middle, Plane=PlaneXY(0, 0, 0))  # -> Geometry, Transform
unit_x = UnitX(Factor=1)
number_slider_4 = Slider(74, range=0..100)
curve_6 = Curve(<curve referenced from the Rhino model>)
curve_7 = Curve(<curve referenced from the Rhino model>)
rotate_3d = Rotate3D(Geometry=curve_5, Angle=degrees(Slider(13, range=-90..90)), Center=project.Geometry, Axis=unit_x)  # -> Geometry, Transform
divide_curve_4 = DivideCurve(Curve=curve_7, Count=number_slider_4, Kinks=False)  # -> Points, Tangents, Parameters
divide_curve_5 = DivideCurve(Curve=rotate_3d.Geometry, Count=number_slider_4, Kinks=False)  # -> Points, Tangents, Parameters
divide_curve_6 = DivideCurve(Curve=curve_6, Count=number_slider_4, Kinks=False)  # -> Points, Tangents, Parameters
line_2 = Line(StartPoint=divide_curve_5.Points, EndPoint=divide_curve_6.Points)
line_3 = Line(StartPoint=divide_curve_5.Points, EndPoint=divide_curve_4.Points)
graft_tree = GraftTree(Tree=line_3, IncludeEmptyLists=True, IncludeNullItems=True)
graft_tree_2 = GraftTree(Tree=line_2, IncludeEmptyLists=True, IncludeNullItems=True)
loft_2 = Loft(
    Curves=[graft_tree, graft_tree_2],
    Options={Adjust=False, Closed=False, LoftEnds=0, LoftSimp=0, LoftType=0, Rebuild=10, Refit=0.01})
custom_preview_3 = CustomPreview(Geometry=loft_2, Material=ColourSwatch(SwatchColor=RGB(81, 193, 193)))

number_slider_5 = Slider(6, range=0..6)

join_curves = JoinCurves(Curves=[curve_7, rotate_3d.Geometry], Preserve=False)
pipe_4 = Pipe(Curve=join_curves, Radius=Slider(0.08, range=0..1), Caps=0)

curve_8 = Curve(<curve referenced from the Rhino model>)
series = Series(Start=Slider(0, range=0..10), Step=Slider(10, range=0..10), Count=number_slider_5)
negative = Negative(Value=series)
area_2 = Area(Geometry=curve_8)  # -> Area, Centroid
unit_z = UnitZ(Factor=Slider(18, range=0..20))
number_slider_6 = Slider(8, range=0..10)
offset_curve = OffsetCurve(Curve=curve_8, Distance=negative, Corners=1)  # -> flatten(Curve)
move = Move(Geometry=area_2.Centroid, Motion=unit_z)  # -> Geometry, Transform
series_2 = Series(Start=Slider(0, range=0..10), Step=number_slider_6, Count=number_slider_5)
xy_plane = XYPlane(Origin=move.Geometry)
unit_z_2 = UnitZ(Factor=series_2)
move_2 = Move(Geometry=offset_curve, Motion=unit_z_2)  # -> Geometry, Transform
unit_z_3 = UnitZ(Factor=number_slider_6)
extrude = Extrude(Base=move_2.Geometry, Direction=unit_z_3)
cap_holes = CapHoles(Brep=extrude)

# ----
# SANTIAGO
number_slider_7 = Slider(0.4, range=0..1)
curve_9 = Curve(<curve referenced from the Rhino model>)
evaluate_curve = EvaluateCurve(Curve=reparameterize(curve_8), Parameter=number_slider_7)  # -> Point, Tangent, Angle
series_3 = Series(Start=Slider(0, range=0..10), Step=Slider(10, range=0..10), Count=number_slider_5)
negative_2 = Negative(Value=series_3)
area_3 = Area(Geometry=curve_9)  # -> Area, Centroid
unit_z_4 = UnitZ(Factor=Slider(18, range=0..20))
number_slider_8 = Slider(8, range=0..10)
offset_curve_2 = OffsetCurve(Curve=curve_9, Distance=negative_2, Corners=1)  # -> flatten(Curve)
move_3 = Move(Geometry=area_3.Centroid, Motion=unit_z_4)  # -> Geometry, Transform
series_4 = Series(Start=Slider(0, range=0..10), Step=number_slider_8, Count=number_slider_5)
xy_plane_2 = XYPlane(Origin=move_3.Geometry)
unit_z_5 = UnitZ(Factor=series_4)
move_4 = Move(Geometry=offset_curve_2, Motion=unit_z_5)  # -> Geometry, Transform
unit_z_6 = UnitZ(Factor=number_slider_8)
extrude_2 = Extrude(Base=move_4.Geometry, Direction=unit_z_6)
cap_holes_2 = CapHoles(Brep=extrude_2)
mirror = Mirror(Plane=PlaneYZ(0, 0, 0))  # -> Geometry, Transform
rotate_2 = Rotate(Geometry=mirror.Geometry, Angle=degrees(Slider(180, range=0..180)), Plane=PlaneXY(0, 0, 0))  # -> Geometry, Transform
unit_y = UnitY(Factor=Slider(10, range=0..10))
move_5 = Move(Geometry=rotate_2.Geometry, Motion=unit_y)  # -> Geometry, Transform

colour_picker = ColourPicker(PickedColour=RGB(171, 171, 171))
colour_picker_2 = ColourPicker(PickedColour=RGB(163, 163, 163))
custom_preview_4 = CustomPreview(Geometry=cap_holes, Material=colour_picker)
custom_preview_5 = CustomPreview(Geometry=cap_holes_2, Material=colour_picker_2)

number_slider_9 = Slider(50, range=0..50)
series_5 = Series(Start=Slider(0.1, range=0..0.1), Step=Slider(0.1, range=0..0.1), Count=number_slider_9)
graph_mapper = GraphMapper(
    series_5,
    x0=0,
    x1=1,
    y0=0,
    y1=1,
    amplitude=0.2945202589,
    container_name="Perlin",
    decay=0.3,
    frequency=0.1810572743,
    x_offset=0.5,
    y_offset=0.5)
bounds = Bounds(Numbers=graph_mapper)
remap_numbers = RemapNumbers(Value=graph_mapper, Source=bounds, Target=Slider(17, range=0..400))  # -> Mapped, Clipped

# ----
# SAUNG
curve_10 = Curve(<curve referenced from the Rhino model>)
divide_curve_7 = DivideCurve(Curve=curve_10, Count=number_slider_9, Kinks=False)  # -> Points, Tangents, Parameters
unit_z_7 = UnitZ(Factor=remap_numbers.Mapped)
move_6 = Move(Geometry=divide_curve_7.Points, Motion=unit_z_7)  # -> Geometry, Transform
interpolate_2 = Interpolate(Vertices=move_6.Geometry, Degree=3, Periodic=False, KnotStyle=1)  # -> flatten(Curve), Length, Domain
curve_11 = Curve(<curve referenced from the Rhino model>)
loft_3 = Loft(
    Curves=[interpolate_2.Curve, curve_11],
    Options={Adjust=False, Closed=False, LoftEnds=0, LoftSimp=0, LoftType=0, Rebuild=10, Refit=0.01})

# ----
# MATTHEW
number_slider_10 = Slider(6, range=0..25)
point = Point(<point referenced from the Rhino model>)
unit_x_2 = UnitX(Factor=number_slider_10)
unit_y_2 = UnitY(Factor=Slider(23, range=0..25))
# MATTHEW
number_slider_11 = Slider(25, range=0..25)
move_7 = Move(Geometry=point, Motion=unit_x_2)  # -> Geometry, Transform
move_8 = Move(Geometry=point, Motion=unit_y_2)  # -> Geometry, Transform
unit_y_3 = UnitY(Factor=number_slider_11)
unit_z_8 = UnitZ(Factor=[Slider(25, range=0..25), Slider(13, range=0..25)])
move_9 = Move(Geometry=move_7.Geometry, Motion=unit_y_3)  # -> Geometry, Transform
unit_x_3 = UnitX(Factor=Slider(12, range=0..20))
unit_z_9 = UnitZ(Factor=Slider(14, range=0..25))
move_10 = Move(Geometry=move_7.Geometry, Motion=unit_z_8)  # -> Geometry, Transform
move_11 = Move(Geometry=move_10.Geometry, Motion=unit_x_3)  # -> Geometry, Transform
move_12 = Move(Geometry=move_8.Geometry, Motion=unit_z_9)  # -> Geometry, Transform
number_slider_12 = Slider(46, range=0..75)
line_4 = Line(StartPoint=move_11.Geometry, EndPoint=point)  # -> graft(Line)
line_5 = Line(StartPoint=move_9.Geometry, EndPoint=move_12.Geometry)
divide_curve_8 = DivideCurve(Curve=line_4, Count=number_slider_12, Kinks=False)  # -> Points, Tangents, Parameters
divide_curve_9 = DivideCurve(Curve=line_5, Count=number_slider_12, Kinks=False)  # -> Points, Tangents, Parameters
number_slider_13 = Slider(4, range=0..10)
line_6 = Line(StartPoint=divide_curve_8.Points, EndPoint=divide_curve_9.Points)
number_slider_14 = Slider(0.25, range=0..2)
pipe_5 = Pipe(Curve=line_6, Radius=Slider(0.083, range=0..3), Caps=0)
yz_plane = YZPlane(Origin=point)
polygon = Polygon(Plane=line_4, Radius=number_slider_14, Segments=number_slider_13, FilletRadius=0)  # -> Polygon, Length
polygon_2 = Polygon(Plane=line_5, Radius=number_slider_14, Segments=number_slider_13, FilletRadius=0)  # -> Polygon, Length
sweep1 = Sweep1(Rail=line_4, Sections=polygon.Polygon, Miter=1)
sweep1_2 = Sweep1(Rail=line_5, Sections=polygon_2.Polygon, Miter=1)
mirror_2 = Mirror(Geometry=[pipe_5, sweep1_2, sweep1], Plane=yz_plane)  # -> Geometry, Transform

list_item_4 = ListItem(List=line_6, Index=Slider(0, range=0..100), Wrap=True)
