# Grasshopper definition thermal_study.ghx (Grasshopper 1.0.7)
# plug-ins: Bifocals

# ----
# IMPORT CLIMATE DATA
toggle = BooleanToggle(True)
open_weather_file = Ladybug_OpenEPWWeatherFile(open=toggle)  # -> epwFile; plug-in component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
importepw = Ladybug_ImportEpw(epwFile=open_weather_file)  # -> readMe, latitude, location, dryBulbTemperature, dewPointTemperature, relativeHumidity, windSpeed, windDirection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; plug-in component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

ladybug = Ladybug_Ladybug()  # -> Vviiiiiiiiiizzz; plug-in component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
gradientlibrary = Ladybug_GradientLibrary(gradIndex=Slider(11, range=0..100))  # -> customColors; plug-in component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
panel = Panel(ladybug)
legendpar = Ladybug_LegendParameters(customColors=flatten(gradientlibrary))  # -> legendPar; plug-in component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
analysisperiod = Ladybug_AnalysisPeriod(
    fromMonth=Slider(1, range=0..1),
    fromDay=Slider(21, range=0..100),
    fromHour=Slider(9, range=0..10),
    toMonth=Slider(12, range=0..100),
    toDay=Slider(21, range=0..100),
    toHour=Slider(18, range=0..100))  # -> readMe, analysisPeriod; plug-in component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
pt = Point(<point referenced from the Rhino model>)
windrose = Ladybug_WindRose(
    north=0,
    hourlyWindDirection=importepw.windDirection,
    hourlyWindSpeed=importepw.windSpeed,
    analysisPeriod=analysisperiod.analysisPeriod,
    centerPoint=pt,
    legendPar=legendpar,
    runIt=Toggle(True))  # -> readMe, calmRoseMesh, windRoseMesh, windRoseCrvs, windRoseCenPts, legend, legendBasePts, title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; plug-in component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

# ----
# HOURS
number_slider = Slider(8, range=0..10)
series = Series(Start=number_slider, Step=1, Count=Slider(11, range=0..20))

# ----
# MONTHS
number_slider_2 = Slider(1, range=0..1)
series_2 = Series(Start=number_slider_2, Step=1, Count=Slider(12, range=0..100))

# ----
# SUNPATH DIAGRAM
number_slider_3 = Slider(0.5, range=0..1)
pt_2 = Point(<point referenced from the Rhino model>)
sunpath = Ladybug_SunPath(
    location=importepw.location,
    hour=series,
    day=21,
    month=series_2,
    timeStep=1,
    centerPt=pt_2,
    sunPathScale=number_slider_3,
    annualHourlyData=flatten(importepw.dryBulbTemperature),
    dailyOrAnnualSunPath=True)  # -> readMe, sunVectors, sunAltitudes, sunAzimuths, port, sunSpheresMesh, sunPathCrvs, compassCrvs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; plug-in component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

# ----
# OPTIONAL LEGEND
number_slider_4 = Slider(0, range=0..100)
gradientlibrary_2 = Ladybug_GradientLibrary(gradIndex=number_slider_4)  # -> customColors; plug-in component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
legendpar_2 = Ladybug_LegendParameters(customColors=flatten(gradientlibrary_2), legendLocation="1000,1000")  # -> legendPar; plug-in component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

# ----
# SOLAR HOPUR ANALYSIS
number_slider_5 = Slider(48, range=0..100)
geometry = Brep([<brep referenced from the Rhino model> x1626])
context = Brep([<brep referenced from the Rhino model> x13])
sunlighthoursanalysis = Ladybug_SunlightHoursAnalysis(
    geometry=flatten(geometry),
    context=flatten(context),
    gridSize=number_slider_5,
    disFromBase="0.1",
    sunVectors=flatten(sunpath.sunVectors),
    timeStep=1,
    legendPar=flatten(legendpar_2),
    runIt=Toggle(True))  # -> readMe, contextMesh, analysisMesh, testPts, testVec, port, sunlightHoursResult, sunlightHoursMesh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; plug-in component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
