# Grasshopper definition illinois_institute_of_technology_truss_system.gh (Grasshopper 1.0.7)
# plug-ins: Kangaroo2 Components

# TOP
number_slider = Slider(220, range=0..240)
number_slider_2 = Slider(240, range=0..240)
number_slider_3 = Slider(0, range=0..40)
number_slider_4 = Slider(20, range=0..40)
number_slider_5 = Slider(40, range=0..40)
number_slider_6 = Slider(20, range=0..40)
number_slider_7 = Slider(0, range=0..40)
number_slider_8 = Slider(20, range=0..40)
number_slider_9 = Slider(40, range=0..40)
number_slider_10 = Slider(60, range=0..60)
number_slider_11 = Slider(20, range=0..40)
number_slider_12 = Slider(40, range=0..40)
number_slider_13 = Slider(60, range=0..60)
number_slider_14 = Slider(40, range=0..40)

# ----
# P1
number_slider_15 = Slider(0, range=0..40)
construct_point = ConstructPoint(XCoordinate=number_slider_15, YCoordinate=Slider(110, range=0..120), ZCoordinate=number_slider_3)

# ----
# P1
number_slider_16 = Slider(0, range=0..40)
construct_point_2 = ConstructPoint(XCoordinate=number_slider_16, YCoordinate=Slider(110, range=0..120), ZCoordinate=number_slider_4)

# ----
# P1
number_slider_17 = Slider(0, range=0..40)
construct_point_3 = ConstructPoint(XCoordinate=number_slider_17, YCoordinate=Slider(110, range=0..120), ZCoordinate=number_slider_5)

# ----
# P1
number_slider_18 = Slider(0, range=0..40)
construct_point_4 = ConstructPoint(XCoordinate=number_slider_18, YCoordinate=Slider(110, range=0..120), ZCoordinate=number_slider_6)

# ----
# P2
number_slider_19 = Slider(0, range=0..40)
construct_point_5 = ConstructPoint(XCoordinate=number_slider_19, YCoordinate=Slider(130, range=0..140), ZCoordinate=number_slider_3)

# ----
# P3
number_slider_20 = Slider(20, range=0..40)
construct_point_6 = ConstructPoint(XCoordinate=number_slider_20, YCoordinate=Slider(110, range=0..120), ZCoordinate=number_slider_4)

# ----
# P2
number_slider_21 = Slider(0, range=0..40)
construct_point_7 = ConstructPoint(XCoordinate=number_slider_21, YCoordinate=Slider(130, range=0..140), ZCoordinate=number_slider_6)

# ----
# P3
number_slider_22 = Slider(20, range=0..40)
construct_point_8 = ConstructPoint(XCoordinate=number_slider_22, YCoordinate=Slider(110, range=0..120), ZCoordinate=number_slider_5)

# ----
# P3
number_slider_23 = Slider(20, range=0..40)
construct_point_9 = ConstructPoint(XCoordinate=number_slider_23, YCoordinate=Slider(110, range=0..120), ZCoordinate=number_slider_3)

# ----
# P2
number_slider_24 = Slider(0, range=0..40)
construct_point_10 = ConstructPoint(XCoordinate=number_slider_24, YCoordinate=Slider(130, range=0..140), ZCoordinate=number_slider_4)

# ----
# P3
number_slider_25 = Slider(20, range=0..40)
construct_point_11 = ConstructPoint(XCoordinate=number_slider_25, YCoordinate=Slider(110, range=0..120), ZCoordinate=number_slider_6)

# ----
# P2
number_slider_26 = Slider(0, range=0..40)
construct_point_12 = ConstructPoint(XCoordinate=number_slider_26, YCoordinate=Slider(130, range=0..140), ZCoordinate=number_slider_5)

# ----
# P4
number_slider_27 = Slider(20, range=0..40)
construct_point_13 = ConstructPoint(XCoordinate=number_slider_27, YCoordinate=Slider(130, range=0..140), ZCoordinate=number_slider_3)

# ----
# P4
number_slider_28 = Slider(20, range=0..40)
construct_point_14 = ConstructPoint(XCoordinate=number_slider_28, YCoordinate=Slider(130, range=0..140), ZCoordinate=number_slider_4)

# ----
# P4
number_slider_29 = Slider(20, range=0..40)
construct_point_15 = ConstructPoint(XCoordinate=number_slider_29, YCoordinate=Slider(130, range=0..140), ZCoordinate=number_slider_6)

# ----
# P4
number_slider_30 = Slider(20, range=0..40)
construct_point_16 = ConstructPoint(XCoordinate=number_slider_30, YCoordinate=Slider(130, range=0..140), ZCoordinate=number_slider_5)

# ----
# COLUMN
# BASE MODULE
# POINTS
# BASE
# P1
number_slider_31 = Slider(0, range=0..40)
construct_point_17 = ConstructPoint(XCoordinate=number_slider_31, YCoordinate=Slider(0, range=0..40), ZCoordinate=number_slider_7)

# ----
# TOP
# P1
number_slider_32 = Slider(0, range=0..40)
construct_point_18 = ConstructPoint(XCoordinate=number_slider_32, YCoordinate=Slider(0, range=0..40), ZCoordinate=number_slider_8)

# ----
# POINTS
# BASE
# P1
number_slider_33 = Slider(0, range=0..40)
construct_point_19 = ConstructPoint(XCoordinate=number_slider_33, YCoordinate=Slider(0, range=0..40), ZCoordinate=number_slider_11)

# ----
# TOP
number_slider_34 = Slider(0, range=0..40)
construct_point_20 = ConstructPoint(XCoordinate=number_slider_34, YCoordinate=Slider(0, range=0..40), ZCoordinate=number_slider_9)

# ----
# P1
number_slider_35 = Slider(0, range=0..40)
construct_point_21 = ConstructPoint(XCoordinate=number_slider_35, YCoordinate=Slider(110, range=0..120), ZCoordinate=number_slider_10)

# ----
# P1
number_slider_36 = Slider(0, range=0..40)
construct_point_22 = ConstructPoint(XCoordinate=number_slider_36, YCoordinate=Slider(110, range=0..120), ZCoordinate=number_slider_12)

# ----
# P2
number_slider_37 = Slider(0, range=0..40)
construct_point_23 = ConstructPoint(XCoordinate=number_slider_37, YCoordinate=Slider(20, range=0..40), ZCoordinate=number_slider_7)

# ----
# P3
number_slider_38 = Slider(20, range=0..40)
construct_point_24 = ConstructPoint(XCoordinate=number_slider_38, YCoordinate=Slider(0, range=0..40), ZCoordinate=number_slider_8)

construct_point_25 = ConstructPoint(XCoordinate=Slider(0, range=0..40), YCoordinate=Slider(20, range=0..40), ZCoordinate=number_slider_11)

construct_point_26 = ConstructPoint(XCoordinate=Slider(20, range=0..40), YCoordinate=Slider(0, range=0..40), ZCoordinate=number_slider_9)

# ----
# P2
number_slider_39 = Slider(0, range=0..40)
construct_point_27 = ConstructPoint(XCoordinate=number_slider_39, YCoordinate=Slider(130, range=0..140), ZCoordinate=number_slider_12)

# ----
# P3
number_slider_40 = Slider(20, range=0..40)
construct_point_28 = ConstructPoint(XCoordinate=number_slider_40, YCoordinate=Slider(110, range=0..120), ZCoordinate=number_slider_10)

# ----
# P3
number_slider_41 = Slider(20, range=0..40)
construct_point_29 = ConstructPoint(XCoordinate=number_slider_41, YCoordinate=Slider(0, range=0..40), ZCoordinate=number_slider_7)

# ----
# P2
number_slider_42 = Slider(0, range=0..40)
construct_point_30 = ConstructPoint(XCoordinate=number_slider_42, YCoordinate=Slider(20, range=0..40), ZCoordinate=number_slider_8)

construct_point_31 = ConstructPoint(XCoordinate=Slider(20, range=0..40), YCoordinate=Slider(0, range=0..40), ZCoordinate=number_slider_11)

construct_point_32 = ConstructPoint(XCoordinate=Slider(0, range=0..40), YCoordinate=Slider(20, range=0..40), ZCoordinate=number_slider_9)

# ----
# P3
number_slider_43 = Slider(20, range=0..40)
construct_point_33 = ConstructPoint(XCoordinate=number_slider_43, YCoordinate=Slider(110, range=0..120), ZCoordinate=number_slider_12)

# ----
# P2
number_slider_44 = Slider(0, range=0..40)
construct_point_34 = ConstructPoint(XCoordinate=number_slider_44, YCoordinate=Slider(130, range=0..140), ZCoordinate=number_slider_10)

# ----
# P4
number_slider_45 = Slider(20, range=0..40)
construct_point_35 = ConstructPoint(XCoordinate=number_slider_45, YCoordinate=Slider(20, range=0..40), ZCoordinate=number_slider_7)

# ----
# P4
number_slider_46 = Slider(20, range=0..40)
# MODULE 2
number_slider_47 = Slider(20, range=0..40)
construct_point_36 = ConstructPoint(XCoordinate=number_slider_46, YCoordinate=number_slider_47, ZCoordinate=number_slider_8)

construct_point_37 = ConstructPoint(XCoordinate=Slider(20, range=0..40), YCoordinate=Slider(20, range=0..40), ZCoordinate=number_slider_11)

# ----
# P4
number_slider_48 = Slider(20, range=0..40)
construct_point_38 = ConstructPoint(XCoordinate=number_slider_48, YCoordinate=Slider(130, range=0..140), ZCoordinate=number_slider_12)

# ----
# MODULE 3
number_slider_49 = Slider(20, range=0..40)
construct_point_39 = ConstructPoint(XCoordinate=Slider(20, range=0..40), YCoordinate=number_slider_49, ZCoordinate=number_slider_9)

# ----
# BASE MODULE
# POINTS
# BASE
# TOP
number_slider_50 = Slider(130, range=0..140)

# ----
# P4
number_slider_51 = Slider(20, range=0..40)
construct_point_40 = ConstructPoint(XCoordinate=number_slider_51, YCoordinate=number_slider_50, ZCoordinate=number_slider_10)

# ----
# POINTS
# BASE
number_slider_52 = Slider(0, range=0..40)
construct_point_41 = ConstructPoint(XCoordinate=number_slider_52, YCoordinate=Slider(0, range=0..40), ZCoordinate=number_slider_14)

# ----
# TOP
number_slider_53 = Slider(0, range=0..40)
construct_point_42 = ConstructPoint(XCoordinate=number_slider_53, YCoordinate=Slider(0, range=0..40), ZCoordinate=number_slider_13)

construct_point_43 = ConstructPoint(XCoordinate=Slider(0, range=0..40), YCoordinate=Slider(20, range=0..40), ZCoordinate=number_slider_14)

construct_point_44 = ConstructPoint(XCoordinate=Slider(20, range=0..40), YCoordinate=Slider(0, range=0..40), ZCoordinate=number_slider_13)

construct_point_45 = ConstructPoint(XCoordinate=Slider(20, range=0..40), YCoordinate=Slider(0, range=0..40), ZCoordinate=number_slider_14)

construct_point_46 = ConstructPoint(XCoordinate=Slider(0, range=0..40), YCoordinate=Slider(20, range=0..40), ZCoordinate=number_slider_13)

construct_point_47 = ConstructPoint(XCoordinate=Slider(20, range=0..40), YCoordinate=Slider(20, range=0..40), ZCoordinate=number_slider_14)

construct_point_48 = ConstructPoint(XCoordinate=Slider(20, range=0..40), YCoordinate=Slider(20, range=0..40), ZCoordinate=number_slider_13)

# ----
# BASE LINES
line = Line(StartPoint=construct_point, EndPoint=construct_point_5)
line_2 = Line(StartPoint=construct_point_9, EndPoint=construct_point)
line_3 = Line(StartPoint=construct_point_5, EndPoint=construct_point_13)
line_4 = Line(StartPoint=construct_point_13, EndPoint=construct_point_9)
line_5 = Line(StartPoint=construct_point_2, EndPoint=construct_point_10)
line_6 = Line(StartPoint=construct_point_6, EndPoint=construct_point_2)
line_7 = Line(StartPoint=construct_point_10, EndPoint=construct_point_14)
line_8 = Line(StartPoint=construct_point_14, EndPoint=construct_point_6)

# ----
# BASE LINES
line_9 = Line(StartPoint=construct_point_4, EndPoint=construct_point_7)
line_10 = Line(StartPoint=construct_point_11, EndPoint=construct_point_4)
line_11 = Line(StartPoint=construct_point_7, EndPoint=construct_point_15)
line_12 = Line(StartPoint=construct_point_15, EndPoint=construct_point_11)
line_13 = Line(StartPoint=construct_point_3, EndPoint=construct_point_12)
line_14 = Line(StartPoint=construct_point_8, EndPoint=construct_point_3)
line_15 = Line(StartPoint=construct_point_12, EndPoint=construct_point_16)
line_16 = Line(StartPoint=construct_point_16, EndPoint=construct_point_8)

# ----
# BASE LINES
line_17 = Line(StartPoint=construct_point_17, EndPoint=construct_point_23)
line_18 = Line(StartPoint=construct_point_29, EndPoint=construct_point_17)
line_19 = Line(StartPoint=construct_point_23, EndPoint=construct_point_35)
line_20 = Line(StartPoint=construct_point_35, EndPoint=construct_point_29)
line_21 = Line(StartPoint=construct_point_18, EndPoint=construct_point_30)
line_22 = Line(StartPoint=construct_point_24, EndPoint=construct_point_18)
line_23 = Line(StartPoint=construct_point_30, EndPoint=construct_point_36)
line_24 = Line(StartPoint=construct_point_36, EndPoint=construct_point_24)

# ----
# BASE LINES
line_25 = Line(StartPoint=construct_point_19, EndPoint=construct_point_25)
line_26 = Line(StartPoint=construct_point_31, EndPoint=construct_point_19)
line_27 = Line(StartPoint=construct_point_25, EndPoint=construct_point_37)
line_28 = Line(StartPoint=construct_point_37, EndPoint=construct_point_31)
line_29 = Line(StartPoint=construct_point_20, EndPoint=construct_point_32)
line_30 = Line(StartPoint=construct_point_26, EndPoint=construct_point_20)
line_31 = Line(StartPoint=construct_point_32, EndPoint=construct_point_39)
line_32 = Line(StartPoint=construct_point_39, EndPoint=construct_point_26)

# ----
# BASE LINES
line_33 = Line(StartPoint=construct_point_22, EndPoint=construct_point_27)
line_34 = Line(StartPoint=construct_point_33, EndPoint=construct_point_22)
line_35 = Line(StartPoint=construct_point_27, EndPoint=construct_point_38)
line_36 = Line(StartPoint=construct_point_38, EndPoint=construct_point_33)
line_37 = Line(StartPoint=construct_point_21, EndPoint=construct_point_34)
line_38 = Line(StartPoint=construct_point_28, EndPoint=construct_point_21)
line_39 = Line(StartPoint=construct_point_34, EndPoint=construct_point_40)
line_40 = Line(StartPoint=construct_point_40, EndPoint=construct_point_28)

# ----
# BASE LINES
line_41 = Line(StartPoint=construct_point_41, EndPoint=construct_point_43)
line_42 = Line(StartPoint=construct_point_45, EndPoint=construct_point_41)
line_43 = Line(StartPoint=construct_point_43, EndPoint=construct_point_47)
line_44 = Line(StartPoint=construct_point_47, EndPoint=construct_point_45)
line_45 = Line(StartPoint=construct_point_42, EndPoint=construct_point_46)
line_46 = Line(StartPoint=construct_point_44, EndPoint=construct_point_42)
line_47 = Line(StartPoint=construct_point_46, EndPoint=construct_point_48)
line_48 = Line(StartPoint=construct_point_48, EndPoint=construct_point_44)

# ----
# MODULE 3
number_slider_54 = Slider(20, range=0..40)
number_slider_55 = Slider(40, range=0..40)
# MODULE 2
# POINTS
# BASE
# TOP
number_slider_56 = Slider(0, range=0..40)
number_slider_57 = Slider(20, range=0..40)
number_slider_58 = Slider(60, range=0..60)
number_slider_59 = Slider(40, range=0..40)

# ----
# DIAGONAL LINES
line_49 = Line(StartPoint=construct_point, EndPoint=construct_point_10)
line_50 = Line(StartPoint=construct_point_5, EndPoint=construct_point_2)
line_51 = Line(StartPoint=construct_point, EndPoint=construct_point_6)
line_52 = Line(StartPoint=construct_point_5, EndPoint=construct_point_14)
line_53 = Line(StartPoint=construct_point_13, EndPoint=construct_point_6)
line_54 = Line(StartPoint=construct_point_9, EndPoint=construct_point_14)

# ----
# DIAGONAL LINES
line_55 = Line(StartPoint=construct_point_4, EndPoint=construct_point_12)
line_56 = Line(StartPoint=construct_point_7, EndPoint=construct_point_3)
line_57 = Line(StartPoint=construct_point_4, EndPoint=construct_point_8)
line_58 = Line(StartPoint=construct_point_7, EndPoint=construct_point_16)
line_59 = Line(StartPoint=construct_point_15, EndPoint=construct_point_8)
line_60 = Line(StartPoint=construct_point_11, EndPoint=construct_point_16)

# ----
# DIAGONAL LINES
line_61 = Line(StartPoint=construct_point_17, EndPoint=construct_point_30)
line_62 = Line(StartPoint=construct_point_23, EndPoint=construct_point_18)
line_63 = Line(StartPoint=construct_point_17, EndPoint=construct_point_24)
line_64 = Line(StartPoint=construct_point_23, EndPoint=construct_point_36)
line_65 = Line(StartPoint=construct_point_35, EndPoint=construct_point_24)
line_66 = Line(StartPoint=construct_point_29, EndPoint=construct_point_36)

# ----
# DIAGONAL LINES
line_67 = Line(StartPoint=construct_point_19, EndPoint=construct_point_32)
line_68 = Line(StartPoint=construct_point_25, EndPoint=construct_point_20)
line_69 = Line(StartPoint=construct_point_19, EndPoint=construct_point_26)
line_70 = Line(StartPoint=construct_point_25, EndPoint=construct_point_39)
line_71 = Line(StartPoint=construct_point_37, EndPoint=construct_point_26)
line_72 = Line(StartPoint=construct_point_31, EndPoint=construct_point_39)

# ----
# DIAGONAL LINES
line_73 = Line(StartPoint=construct_point_22, EndPoint=construct_point_34)
line_74 = Line(StartPoint=construct_point_27, EndPoint=construct_point_21)
line_75 = Line(StartPoint=construct_point_22, EndPoint=construct_point_28)
line_76 = Line(StartPoint=construct_point_27, EndPoint=construct_point_40)
line_77 = Line(StartPoint=construct_point_38, EndPoint=construct_point_28)
line_78 = Line(StartPoint=construct_point_33, EndPoint=construct_point_40)

# ----
# DIAGONAL LINES
line_79 = Line(StartPoint=construct_point_41, EndPoint=construct_point_46)
line_80 = Line(StartPoint=construct_point_43, EndPoint=construct_point_42)
line_81 = Line(StartPoint=construct_point_41, EndPoint=construct_point_44)
line_82 = Line(StartPoint=construct_point_43, EndPoint=construct_point_48)
line_83 = Line(StartPoint=construct_point_47, EndPoint=construct_point_44)
line_84 = Line(StartPoint=construct_point_45, EndPoint=construct_point_48)

# ----
# COLUMN
# P1
number_slider_60 = Slider(0, range=0..40)
construct_point_49 = ConstructPoint(XCoordinate=number_slider_60, YCoordinate=number_slider, ZCoordinate=number_slider_56)

# ----
# P1
number_slider_61 = Slider(0, range=0..40)
construct_point_50 = ConstructPoint(XCoordinate=number_slider_61, YCoordinate=number_slider, ZCoordinate=number_slider_54)

# ----
# P1
number_slider_62 = Slider(0, range=0..40)
construct_point_51 = ConstructPoint(XCoordinate=number_slider_62, YCoordinate=number_slider, ZCoordinate=number_slider_57)

construct_point_52 = ConstructPoint(XCoordinate=Slider(0, range=0..40), YCoordinate=number_slider, ZCoordinate=number_slider_55)

# ----
# P2
number_slider_63 = Slider(0, range=0..40)
construct_point_53 = ConstructPoint(XCoordinate=number_slider_63, YCoordinate=number_slider_2, ZCoordinate=number_slider_56)

# ----
# P3
number_slider_64 = Slider(20, range=0..40)
construct_point_54 = ConstructPoint(XCoordinate=number_slider_64, YCoordinate=number_slider, ZCoordinate=number_slider_54)

construct_point_55 = ConstructPoint(XCoordinate=Slider(0, range=0..40), YCoordinate=number_slider_2, ZCoordinate=number_slider_57)

construct_point_56 = ConstructPoint(XCoordinate=Slider(20, range=0..40), YCoordinate=number_slider, ZCoordinate=number_slider_55)

# ----
# P3
number_slider_65 = Slider(20, range=0..40)
construct_point_57 = ConstructPoint(XCoordinate=number_slider_65, YCoordinate=number_slider, ZCoordinate=number_slider_56)

# ----
# P2
number_slider_66 = Slider(0, range=0..40)
construct_point_58 = ConstructPoint(XCoordinate=number_slider_66, YCoordinate=number_slider_2, ZCoordinate=number_slider_54)

construct_point_59 = ConstructPoint(XCoordinate=Slider(20, range=0..40), YCoordinate=number_slider, ZCoordinate=number_slider_57)

construct_point_60 = ConstructPoint(XCoordinate=Slider(0, range=0..40), YCoordinate=number_slider_2, ZCoordinate=number_slider_55)

# ----
# P4
number_slider_67 = Slider(20, range=0..40)
construct_point_61 = ConstructPoint(XCoordinate=number_slider_67, YCoordinate=number_slider_2, ZCoordinate=number_slider_56)

# ----
# P4
number_slider_68 = Slider(20, range=0..40)
construct_point_62 = ConstructPoint(XCoordinate=number_slider_68, YCoordinate=number_slider_2, ZCoordinate=number_slider_54)

construct_point_63 = ConstructPoint(XCoordinate=Slider(20, range=0..40), YCoordinate=number_slider_2, ZCoordinate=number_slider_57)

construct_point_64 = ConstructPoint(XCoordinate=Slider(20, range=0..40), YCoordinate=number_slider_2, ZCoordinate=number_slider_55)

construct_point_65 = ConstructPoint(XCoordinate=Slider(0, range=0..40), YCoordinate=number_slider, ZCoordinate=number_slider_59)

construct_point_66 = ConstructPoint(XCoordinate=Slider(0, range=0..40), YCoordinate=number_slider, ZCoordinate=number_slider_58)

construct_point_67 = ConstructPoint(XCoordinate=Slider(0, range=0..40), YCoordinate=number_slider_2, ZCoordinate=number_slider_59)

construct_point_68 = ConstructPoint(XCoordinate=Slider(20, range=0..40), YCoordinate=number_slider, ZCoordinate=number_slider_58)

construct_point_69 = ConstructPoint(XCoordinate=Slider(20, range=0..40), YCoordinate=number_slider, ZCoordinate=number_slider_59)

construct_point_70 = ConstructPoint(XCoordinate=Slider(0, range=0..40), YCoordinate=number_slider_2, ZCoordinate=number_slider_58)

construct_point_71 = ConstructPoint(XCoordinate=Slider(20, range=0..40), YCoordinate=number_slider_2, ZCoordinate=number_slider_59)

construct_point_72 = ConstructPoint(XCoordinate=Slider(20, range=0..40), YCoordinate=number_slider_2, ZCoordinate=number_slider_58)

# ----
# VERTICAL LINES
line_85 = Line(StartPoint=construct_point, EndPoint=construct_point_2)
line_86 = Line(StartPoint=construct_point_5, EndPoint=construct_point_10)
line_87 = Line(StartPoint=construct_point_9, EndPoint=construct_point_6)
line_88 = Line(StartPoint=construct_point_13, EndPoint=construct_point_14)

# ----
# VERTICAL LINES
line_89 = Line(StartPoint=construct_point_4, EndPoint=construct_point_3)
line_90 = Line(StartPoint=construct_point_7, EndPoint=construct_point_12)
line_91 = Line(StartPoint=construct_point_11, EndPoint=construct_point_8)
line_92 = Line(StartPoint=construct_point_15, EndPoint=construct_point_16)

# ----
# VERTICAL LINES
line_93 = Line(StartPoint=construct_point_17, EndPoint=construct_point_18)
line_94 = Line(StartPoint=construct_point_23, EndPoint=construct_point_30)
line_95 = Line(StartPoint=construct_point_29, EndPoint=construct_point_24)
line_96 = Line(StartPoint=construct_point_35, EndPoint=construct_point_36)

# ----
# VERTICAL LINES
line_97 = Line(StartPoint=construct_point_19, EndPoint=construct_point_20)
line_98 = Line(StartPoint=construct_point_25, EndPoint=construct_point_32)
line_99 = Line(StartPoint=construct_point_31, EndPoint=construct_point_26)
line_100 = Line(StartPoint=construct_point_37, EndPoint=construct_point_39)

# ----
# VERTICAL LINES
line_101 = Line(StartPoint=construct_point_22, EndPoint=construct_point_21)
line_102 = Line(StartPoint=construct_point_27, EndPoint=construct_point_34)
line_103 = Line(StartPoint=construct_point_33, EndPoint=construct_point_28)
line_104 = Line(StartPoint=construct_point_38, EndPoint=construct_point_40)

# ----
# VERTICAL LINES
line_105 = Line(StartPoint=construct_point_41, EndPoint=construct_point_42)
line_106 = Line(StartPoint=construct_point_43, EndPoint=construct_point_46)
line_107 = Line(StartPoint=construct_point_45, EndPoint=construct_point_44)
line_108 = Line(StartPoint=construct_point_47, EndPoint=construct_point_48)

# ----
# BASE LINES
line_109 = Line(StartPoint=construct_point_49, EndPoint=construct_point_53)
line_110 = Line(StartPoint=construct_point_57, EndPoint=construct_point_49)
line_111 = Line(StartPoint=construct_point_53, EndPoint=construct_point_61)
line_112 = Line(StartPoint=construct_point_61, EndPoint=construct_point_57)
line_113 = Line(StartPoint=construct_point_50, EndPoint=construct_point_58)
line_114 = Line(StartPoint=construct_point_54, EndPoint=construct_point_50)
line_115 = Line(StartPoint=construct_point_58, EndPoint=construct_point_62)
line_116 = Line(StartPoint=construct_point_62, EndPoint=construct_point_54)

# ----
# BASE LINES
line_117 = Line(StartPoint=construct_point_51, EndPoint=construct_point_55)
line_118 = Line(StartPoint=construct_point_59, EndPoint=construct_point_51)
line_119 = Line(StartPoint=construct_point_55, EndPoint=construct_point_63)
line_120 = Line(StartPoint=construct_point_63, EndPoint=construct_point_59)
line_121 = Line(StartPoint=construct_point_52, EndPoint=construct_point_60)
line_122 = Line(StartPoint=construct_point_56, EndPoint=construct_point_52)
line_123 = Line(StartPoint=construct_point_60, EndPoint=construct_point_64)
line_124 = Line(StartPoint=construct_point_64, EndPoint=construct_point_56)

# ----
# BASE LINES
line_125 = Line(StartPoint=construct_point_65, EndPoint=construct_point_67)
line_126 = Line(StartPoint=construct_point_69, EndPoint=construct_point_65)
line_127 = Line(StartPoint=construct_point_67, EndPoint=construct_point_71)
line_128 = Line(StartPoint=construct_point_71, EndPoint=construct_point_69)
line_129 = Line(StartPoint=construct_point_66, EndPoint=construct_point_70)
line_130 = Line(StartPoint=construct_point_68, EndPoint=construct_point_66)
line_131 = Line(StartPoint=construct_point_70, EndPoint=construct_point_72)
line_132 = Line(StartPoint=construct_point_72, EndPoint=construct_point_68)

number_slider_69 = Slider(20, range=0..40)
number_slider_70 = Slider(0, range=0..40)
number_slider_71 = Slider(20, range=0..40)
number_slider_72 = Slider(40, range=0..40)
number_slider_73 = Slider(20, range=0..40)
number_slider_74 = Slider(0, range=0..40)
number_slider_75 = Slider(20, range=0..40)
number_slider_76 = Slider(40, range=0..40)
number_slider_77 = Slider(40, range=0..40)
number_slider_78 = Slider(60, range=0..60)
number_slider_79 = Slider(40, range=0..40)
number_slider_80 = Slider(60, range=0..60)

# ----
# DIAGONAL LINES
line_133 = Line(StartPoint=construct_point_49, EndPoint=construct_point_58)
line_134 = Line(StartPoint=construct_point_53, EndPoint=construct_point_50)
line_135 = Line(StartPoint=construct_point_49, EndPoint=construct_point_54)
line_136 = Line(StartPoint=construct_point_53, EndPoint=construct_point_62)
line_137 = Line(StartPoint=construct_point_61, EndPoint=construct_point_54)
line_138 = Line(StartPoint=construct_point_57, EndPoint=construct_point_62)

# ----
# DIAGONAL LINES
line_139 = Line(StartPoint=construct_point_51, EndPoint=construct_point_60)
line_140 = Line(StartPoint=construct_point_55, EndPoint=construct_point_52)
line_141 = Line(StartPoint=construct_point_51, EndPoint=construct_point_56)
line_142 = Line(StartPoint=construct_point_55, EndPoint=construct_point_64)
line_143 = Line(StartPoint=construct_point_63, EndPoint=construct_point_56)
line_144 = Line(StartPoint=construct_point_59, EndPoint=construct_point_64)

# ----
# DIAGONAL LINES
line_145 = Line(StartPoint=construct_point_65, EndPoint=construct_point_70)
line_146 = Line(StartPoint=construct_point_67, EndPoint=construct_point_66)
line_147 = Line(StartPoint=construct_point_65, EndPoint=construct_point_68)
line_148 = Line(StartPoint=construct_point_67, EndPoint=construct_point_72)
line_149 = Line(StartPoint=construct_point_71, EndPoint=construct_point_68)
line_150 = Line(StartPoint=construct_point_69, EndPoint=construct_point_72)

# ----
# P1
number_slider_81 = Slider(-70, range=-70..40)
construct_point_73 = ConstructPoint(XCoordinate=number_slider_81, YCoordinate=Slider(110, range=0..120), ZCoordinate=number_slider_70)

# ----
# P2
number_slider_82 = Slider(-70, range=-70..40)
construct_point_74 = ConstructPoint(XCoordinate=number_slider_82, YCoordinate=Slider(130, range=0..140), ZCoordinate=number_slider_70)

# ----
# P3
number_slider_83 = Slider(-35, range=-70..40)
construct_point_75 = ConstructPoint(XCoordinate=number_slider_83, YCoordinate=Slider(110, range=0..120), ZCoordinate=number_slider_70)

# ----
# P4
number_slider_84 = Slider(-35, range=-70..40)
construct_point_76 = ConstructPoint(XCoordinate=number_slider_84, YCoordinate=Slider(130, range=0..140), ZCoordinate=number_slider_70)

# ----
# COLUMN
# BASE MODULE
# POINTS
# BASE
# P1
number_slider_85 = Slider(-70, range=-70..40)
construct_point_77 = ConstructPoint(XCoordinate=number_slider_85, YCoordinate=Slider(0, range=-70..40), ZCoordinate=number_slider_74)

# ----
# TOP
number_slider_86 = Slider(-70, range=-70..40)

# ----
# P1
number_slider_87 = Slider(0, range=0..40)
construct_point_78 = ConstructPoint(XCoordinate=number_slider_86, YCoordinate=number_slider_87, ZCoordinate=number_slider_73)

# ----
# POINTS
# BASE
number_slider_88 = Slider(-70, range=-70..40)

# ----
# P1
number_slider_89 = Slider(0, range=0..40)
construct_point_79 = ConstructPoint(XCoordinate=number_slider_88, YCoordinate=number_slider_89, ZCoordinate=number_slider_75)

# ----
# P2
number_slider_90 = Slider(-70, range=-70..40)
construct_point_80 = ConstructPoint(XCoordinate=number_slider_90, YCoordinate=Slider(20, range=0..40), ZCoordinate=number_slider_74)

# ----
# P3
number_slider_91 = Slider(0, range=0..40)
construct_point_81 = ConstructPoint(XCoordinate=Slider(-35, range=-70..40), YCoordinate=number_slider_91, ZCoordinate=number_slider_73)

# ----
# TOP
number_slider_92 = Slider(-70, range=-70..40)

# ----
# P1
number_slider_93 = Slider(0, range=0..40)
construct_point_82 = ConstructPoint(XCoordinate=number_slider_92, YCoordinate=number_slider_93, ZCoordinate=number_slider_76)

# ----
# P3
number_slider_94 = Slider(-35, range=-70..40)
construct_point_83 = ConstructPoint(XCoordinate=number_slider_94, YCoordinate=Slider(0, range=0..40), ZCoordinate=number_slider_74)

# ----
# P2
number_slider_95 = Slider(20, range=0..40)
construct_point_84 = ConstructPoint(XCoordinate=Slider(-70, range=-70..40), YCoordinate=number_slider_95, ZCoordinate=number_slider_73)

# ----
# P2
number_slider_96 = Slider(20, range=0..40)
construct_point_85 = ConstructPoint(XCoordinate=Slider(-70, range=-70..40), YCoordinate=number_slider_96, ZCoordinate=number_slider_75)

# ----
# P4
number_slider_97 = Slider(-35, range=-70..40)
construct_point_86 = ConstructPoint(XCoordinate=number_slider_97, YCoordinate=Slider(20, range=0..40), ZCoordinate=number_slider_74)

# ----
# P3
number_slider_98 = Slider(0, range=0..40)
construct_point_87 = ConstructPoint(XCoordinate=Slider(-35, range=-70..40), YCoordinate=number_slider_98, ZCoordinate=number_slider_75)

# ----
# P2
number_slider_99 = Slider(20, range=0..40)
construct_point_88 = ConstructPoint(XCoordinate=Slider(-70, range=-70..40), YCoordinate=number_slider_99, ZCoordinate=number_slider_76)

# ----
# P4
# MODULE 2
number_slider_100 = Slider(20, range=0..40)
construct_point_89 = ConstructPoint(XCoordinate=Slider(-35, range=-70..40), YCoordinate=number_slider_100, ZCoordinate=number_slider_73)

# ----
# P4
number_slider_101 = Slider(20, range=0..40)
construct_point_90 = ConstructPoint(XCoordinate=Slider(-35, range=-70..40), YCoordinate=number_slider_101, ZCoordinate=number_slider_75)

# ----
# P3
number_slider_102 = Slider(0, range=0..40)
construct_point_91 = ConstructPoint(XCoordinate=Slider(-35, range=-70..40), YCoordinate=number_slider_102, ZCoordinate=number_slider_76)

# ----
# P4
# MODULE 3
number_slider_103 = Slider(20, range=0..40)
construct_point_92 = ConstructPoint(XCoordinate=Slider(-35, range=-70..40), YCoordinate=number_slider_103, ZCoordinate=number_slider_76)

# ----
# POINTS
# BASE
# TOP
number_slider_104 = Slider(130, range=0..140)
# POINTS
# BASE
number_slider_105 = Slider(-70, range=-70..40)

# ----
# P1
number_slider_106 = Slider(0, range=0..40)
construct_point_93 = ConstructPoint(XCoordinate=number_slider_105, YCoordinate=number_slider_106, ZCoordinate=number_slider_79)

# ----
# TOP
number_slider_107 = Slider(-70, range=-70..40)

# ----
# P1
number_slider_108 = Slider(0, range=0..40)
construct_point_94 = ConstructPoint(XCoordinate=number_slider_107, YCoordinate=number_slider_108, ZCoordinate=number_slider_80)

# ----
# P2
number_slider_109 = Slider(20, range=0..40)
construct_point_95 = ConstructPoint(XCoordinate=Slider(-70, range=-70..40), YCoordinate=number_slider_109, ZCoordinate=number_slider_79)

# ----
# P3
number_slider_110 = Slider(0, range=0..40)
construct_point_96 = ConstructPoint(XCoordinate=Slider(-35, range=-70..40), YCoordinate=number_slider_110, ZCoordinate=number_slider_79)

# ----
# P2
number_slider_111 = Slider(20, range=0..40)
construct_point_97 = ConstructPoint(XCoordinate=Slider(-70, range=-70..40), YCoordinate=number_slider_111, ZCoordinate=number_slider_80)

# ----
# P3
number_slider_112 = Slider(0, range=0..40)
construct_point_98 = ConstructPoint(XCoordinate=Slider(-35, range=-70..40), YCoordinate=number_slider_112, ZCoordinate=number_slider_80)

# ----
# P4
number_slider_113 = Slider(20, range=0..40)
construct_point_99 = ConstructPoint(XCoordinate=Slider(-35, range=-70..40), YCoordinate=number_slider_113, ZCoordinate=number_slider_79)

# ----
# P4
number_slider_114 = Slider(20, range=0..40)
construct_point_100 = ConstructPoint(XCoordinate=Slider(-35, range=-70..40), YCoordinate=number_slider_114, ZCoordinate=number_slider_80)

# ----
# VERTICAL LINES
line_151 = Line(StartPoint=construct_point_49, EndPoint=construct_point_50)
line_152 = Line(StartPoint=construct_point_53, EndPoint=construct_point_58)
line_153 = Line(StartPoint=construct_point_57, EndPoint=construct_point_54)
line_154 = Line(StartPoint=construct_point_61, EndPoint=construct_point_62)

# ----
# VERTICAL LINES
line_155 = Line(StartPoint=construct_point_51, EndPoint=construct_point_52)
line_156 = Line(StartPoint=construct_point_55, EndPoint=construct_point_60)
line_157 = Line(StartPoint=construct_point_59, EndPoint=construct_point_56)
line_158 = Line(StartPoint=construct_point_63, EndPoint=construct_point_64)

# ----
# VERTICAL LINES
line_159 = Line(StartPoint=construct_point_65, EndPoint=construct_point_66)
line_160 = Line(StartPoint=construct_point_67, EndPoint=construct_point_70)
line_161 = Line(StartPoint=construct_point_69, EndPoint=construct_point_68)
line_162 = Line(StartPoint=construct_point_71, EndPoint=construct_point_72)

# ----
# P1
construct_point_101 = ConstructPoint(XCoordinate=Slider(-70, range=-70..40), YCoordinate=Slider(110, range=0..120), ZCoordinate=number_slider_69)

# ----
# P1
construct_point_102 = ConstructPoint(XCoordinate=Slider(-70, range=-70..40), YCoordinate=Slider(110, range=0..120), ZCoordinate=number_slider_71)

# ----
# P1
construct_point_103 = ConstructPoint(XCoordinate=Slider(-70, range=-70..40), YCoordinate=Slider(110, range=0..120), ZCoordinate=number_slider_72)

# ----
# P2
construct_point_104 = ConstructPoint(XCoordinate=Slider(-70, range=-70..40), YCoordinate=Slider(130, range=0..140), ZCoordinate=number_slider_69)

# ----
# P3
construct_point_105 = ConstructPoint(XCoordinate=Slider(-35, range=-70..40), YCoordinate=Slider(110, range=0..120), ZCoordinate=number_slider_69)

# ----
# P2
construct_point_106 = ConstructPoint(XCoordinate=Slider(-70, range=-70..40), YCoordinate=Slider(130, range=0..140), ZCoordinate=number_slider_71)

# ----
# P3
construct_point_107 = ConstructPoint(XCoordinate=Slider(-35, range=-70..40), YCoordinate=Slider(110, range=0..120), ZCoordinate=number_slider_71)

# ----
# P2
construct_point_108 = ConstructPoint(XCoordinate=Slider(-70, range=-70..40), YCoordinate=Slider(130, range=0..140), ZCoordinate=number_slider_72)

# ----
# P3
construct_point_109 = ConstructPoint(XCoordinate=Slider(-35, range=-70..40), YCoordinate=Slider(110, range=0..120), ZCoordinate=number_slider_72)

# ----
# P4
construct_point_110 = ConstructPoint(XCoordinate=Slider(-35, range=-70..40), YCoordinate=Slider(130, range=0..140), ZCoordinate=number_slider_69)

# ----
# P4
construct_point_111 = ConstructPoint(XCoordinate=Slider(-35, range=-70..40), YCoordinate=Slider(130, range=0..140), ZCoordinate=number_slider_71)

# ----
# P4
construct_point_112 = ConstructPoint(XCoordinate=Slider(-35, range=-70..40), YCoordinate=Slider(130, range=0..140), ZCoordinate=number_slider_72)

# ----
# P1
construct_point_113 = ConstructPoint(XCoordinate=Slider(-70, range=-70..40), YCoordinate=Slider(110, range=0..120), ZCoordinate=number_slider_77)

# ----
# P1
construct_point_114 = ConstructPoint(XCoordinate=Slider(-70, range=-70..40), YCoordinate=Slider(110, range=0..120), ZCoordinate=number_slider_78)

# ----
# P2
construct_point_115 = ConstructPoint(XCoordinate=Slider(-70, range=-70..40), YCoordinate=Slider(130, range=0..140), ZCoordinate=number_slider_77)

# ----
# P3
construct_point_116 = ConstructPoint(XCoordinate=Slider(-35, range=-70..40), YCoordinate=Slider(110, range=0..120), ZCoordinate=number_slider_77)

# ----
# P2
construct_point_117 = ConstructPoint(XCoordinate=Slider(-70, range=-70..40), YCoordinate=Slider(130, range=0..140), ZCoordinate=number_slider_78)

# ----
# P3
construct_point_118 = ConstructPoint(XCoordinate=Slider(-35, range=-70..40), YCoordinate=Slider(110, range=0..120), ZCoordinate=number_slider_78)

# ----
# P4
construct_point_119 = ConstructPoint(XCoordinate=Slider(-35, range=-70..40), YCoordinate=Slider(130, range=0..140), ZCoordinate=number_slider_77)

# ----
# P4
construct_point_120 = ConstructPoint(XCoordinate=Slider(-35, range=-70..40), YCoordinate=number_slider_104, ZCoordinate=number_slider_78)

# ----
# BASE LINES
line_163 = Line(StartPoint=construct_point_73, EndPoint=construct_point_74)
line_164 = Line(StartPoint=construct_point_75, EndPoint=construct_point_73)
line_165 = Line(StartPoint=construct_point_74, EndPoint=construct_point_76)
line_166 = Line(StartPoint=construct_point_76, EndPoint=construct_point_75)
line_167 = Line(StartPoint=construct_point_101, EndPoint=construct_point_104)
line_168 = Line(StartPoint=construct_point_105, EndPoint=construct_point_101)
line_169 = Line(StartPoint=construct_point_104, EndPoint=construct_point_110)
line_170 = Line(StartPoint=construct_point_110, EndPoint=construct_point_105)

line_171 = Line(StartPoint=construct_point_102, EndPoint=construct_point_106)
line_172 = Line(StartPoint=construct_point_107, EndPoint=construct_point_102)
line_173 = Line(StartPoint=construct_point_106, EndPoint=construct_point_111)
line_174 = Line(StartPoint=construct_point_111, EndPoint=construct_point_107)
line_175 = Line(StartPoint=construct_point_103, EndPoint=construct_point_108)
line_176 = Line(StartPoint=construct_point_109, EndPoint=construct_point_103)
line_177 = Line(StartPoint=construct_point_108, EndPoint=construct_point_112)
line_178 = Line(StartPoint=construct_point_112, EndPoint=construct_point_109)

# ----
# BASE LINES
line_179 = Line(StartPoint=construct_point_77, EndPoint=construct_point_80)
line_180 = Line(StartPoint=construct_point_83, EndPoint=construct_point_77)
line_181 = Line(StartPoint=construct_point_80, EndPoint=construct_point_86)
line_182 = Line(StartPoint=construct_point_86, EndPoint=construct_point_83)
line_183 = Line(StartPoint=construct_point_78, EndPoint=construct_point_84)
line_184 = Line(StartPoint=construct_point_81, EndPoint=construct_point_78)
line_185 = Line(StartPoint=construct_point_84, EndPoint=construct_point_89)
line_186 = Line(StartPoint=construct_point_89, EndPoint=construct_point_81)

# ----
# BASE LINES
line_187 = Line(StartPoint=construct_point_79, EndPoint=construct_point_85)
line_188 = Line(StartPoint=construct_point_87, EndPoint=construct_point_79)
line_189 = Line(StartPoint=construct_point_85, EndPoint=construct_point_90)
line_190 = Line(StartPoint=construct_point_90, EndPoint=construct_point_87)
line_191 = Line(StartPoint=construct_point_82, EndPoint=construct_point_88)
line_192 = Line(StartPoint=construct_point_91, EndPoint=construct_point_82)
line_193 = Line(StartPoint=construct_point_88, EndPoint=construct_point_92)
line_194 = Line(StartPoint=construct_point_92, EndPoint=construct_point_91)

# ----
# BASE LINES
line_195 = Line(StartPoint=construct_point_113, EndPoint=construct_point_115)
line_196 = Line(StartPoint=construct_point_116, EndPoint=construct_point_113)
line_197 = Line(StartPoint=construct_point_115, EndPoint=construct_point_119)
line_198 = Line(StartPoint=construct_point_119, EndPoint=construct_point_116)
line_199 = Line(StartPoint=construct_point_114, EndPoint=construct_point_117)
line_200 = Line(StartPoint=construct_point_118, EndPoint=construct_point_114)
line_201 = Line(StartPoint=construct_point_117, EndPoint=construct_point_120)
line_202 = Line(StartPoint=construct_point_120, EndPoint=construct_point_118)

# ----
# BASE LINES
line_203 = Line(StartPoint=construct_point_93, EndPoint=construct_point_95)
line_204 = Line(StartPoint=construct_point_96, EndPoint=construct_point_93)
line_205 = Line(StartPoint=construct_point_95, EndPoint=construct_point_99)
line_206 = Line(StartPoint=construct_point_99, EndPoint=construct_point_96)
line_207 = Line(StartPoint=construct_point_94, EndPoint=construct_point_97)
line_208 = Line(StartPoint=construct_point_98, EndPoint=construct_point_94)
line_209 = Line(StartPoint=construct_point_97, EndPoint=construct_point_100)
line_210 = Line(StartPoint=construct_point_100, EndPoint=construct_point_98)

# ----
# TOP
number_slider_115 = Slider(0, range=0..40)
# MODULE 3
# POINTS
# BASE
number_slider_116 = Slider(20, range=0..40)
# TOP
number_slider_117 = Slider(20, range=0..40)
number_slider_118 = Slider(40, range=0..40)
number_slider_119 = Slider(40, range=0..40)
number_slider_120 = Slider(60, range=0..60)

# ----
# DIAGONAL LINES
line_211 = Line(StartPoint=construct_point_73, EndPoint=construct_point_104)
line_212 = Line(StartPoint=construct_point_74, EndPoint=construct_point_101)
line_213 = Line(StartPoint=construct_point_73, EndPoint=construct_point_105)
line_214 = Line(StartPoint=construct_point_74, EndPoint=construct_point_110)
line_215 = Line(StartPoint=construct_point_76, EndPoint=construct_point_105)
line_216 = Line(StartPoint=construct_point_75, EndPoint=construct_point_110)

# ----
# DIAGONAL LINES
line_217 = Line(StartPoint=construct_point_102, EndPoint=construct_point_108)
line_218 = Line(StartPoint=construct_point_106, EndPoint=construct_point_103)
line_219 = Line(StartPoint=construct_point_102, EndPoint=construct_point_109)
line_220 = Line(StartPoint=construct_point_106, EndPoint=construct_point_112)
line_221 = Line(StartPoint=construct_point_111, EndPoint=construct_point_109)
line_222 = Line(StartPoint=construct_point_107, EndPoint=construct_point_112)
line_223 = Line(StartPoint=construct_point_77, EndPoint=construct_point_84)
line_224 = Line(StartPoint=construct_point_80, EndPoint=construct_point_78)
line_225 = Line(StartPoint=construct_point_77, EndPoint=construct_point_81)
line_226 = Line(StartPoint=construct_point_80, EndPoint=construct_point_89)
line_227 = Line(StartPoint=construct_point_86, EndPoint=construct_point_81)
line_228 = Line(StartPoint=construct_point_83, EndPoint=construct_point_89)
# DIAGONAL LINES
line_229 = Line(StartPoint=construct_point_79, EndPoint=construct_point_88)
line_230 = Line(StartPoint=construct_point_85, EndPoint=construct_point_82)
line_231 = Line(StartPoint=construct_point_79, EndPoint=construct_point_91)
line_232 = Line(StartPoint=construct_point_85, EndPoint=construct_point_92)
line_233 = Line(StartPoint=construct_point_90, EndPoint=construct_point_91)
line_234 = Line(StartPoint=construct_point_87, EndPoint=construct_point_92)

# ----
# DIAGONAL LINES
line_235 = Line(StartPoint=construct_point_113, EndPoint=construct_point_117)
line_236 = Line(StartPoint=construct_point_115, EndPoint=construct_point_114)
line_237 = Line(StartPoint=construct_point_113, EndPoint=construct_point_118)
line_238 = Line(StartPoint=construct_point_115, EndPoint=construct_point_120)
line_239 = Line(StartPoint=construct_point_119, EndPoint=construct_point_118)
line_240 = Line(StartPoint=construct_point_116, EndPoint=construct_point_120)

# ----
# DIAGONAL LINES
line_241 = Line(StartPoint=construct_point_93, EndPoint=construct_point_97)
line_242 = Line(StartPoint=construct_point_95, EndPoint=construct_point_94)
line_243 = Line(StartPoint=construct_point_93, EndPoint=construct_point_98)
line_244 = Line(StartPoint=construct_point_95, EndPoint=construct_point_100)
line_245 = Line(StartPoint=construct_point_99, EndPoint=construct_point_98)
line_246 = Line(StartPoint=construct_point_96, EndPoint=construct_point_100)

# ----
# POINTS
# BASE
# COLUMN
# BASE LINES
# BASE MODULE
# VERTICAL LINES
# P1
# DIAGONAL LINES
number_slider_121 = Slider(-70, range=-70..40)
construct_point_121 = ConstructPoint(XCoordinate=number_slider_121, YCoordinate=number_slider, ZCoordinate=number_slider_115)

# ----
# P2
number_slider_122 = Slider(-70, range=-70..40)
construct_point_122 = ConstructPoint(XCoordinate=number_slider_122, YCoordinate=number_slider_2, ZCoordinate=number_slider_115)

# ----
# MODULE 2
number_slider_123 = Slider(-70, range=-70..40)

# ----
# P3
number_slider_124 = Slider(-35, range=-70..40)
construct_point_123 = ConstructPoint(XCoordinate=number_slider_124, YCoordinate=number_slider, ZCoordinate=number_slider_115)

# ----
# P4
number_slider_125 = Slider(-35, range=-70..40)
construct_point_124 = ConstructPoint(XCoordinate=number_slider_125, YCoordinate=number_slider_2, ZCoordinate=number_slider_115)

# ----
# VERTICAL LINES
line_247 = Line(StartPoint=construct_point_73, EndPoint=construct_point_101)
line_248 = Line(StartPoint=construct_point_74, EndPoint=construct_point_104)
line_249 = Line(StartPoint=construct_point_75, EndPoint=construct_point_105)
line_250 = Line(StartPoint=construct_point_76, EndPoint=construct_point_110)

line_251 = Line(StartPoint=construct_point_102, EndPoint=construct_point_103)
line_252 = Line(StartPoint=construct_point_106, EndPoint=construct_point_108)
line_253 = Line(StartPoint=construct_point_107, EndPoint=construct_point_109)
line_254 = Line(StartPoint=construct_point_111, EndPoint=construct_point_112)
line_255 = Line(StartPoint=construct_point_77, EndPoint=construct_point_78)
line_256 = Line(StartPoint=construct_point_80, EndPoint=construct_point_84)
line_257 = Line(StartPoint=construct_point_83, EndPoint=construct_point_81)
line_258 = Line(StartPoint=construct_point_86, EndPoint=construct_point_89)
# VERTICAL LINES
line_259 = Line(StartPoint=construct_point_79, EndPoint=construct_point_82)
line_260 = Line(StartPoint=construct_point_85, EndPoint=construct_point_88)
line_261 = Line(StartPoint=construct_point_87, EndPoint=construct_point_91)
line_262 = Line(StartPoint=construct_point_90, EndPoint=construct_point_92)

# ----
# VERTICAL LINES
line_263 = Line(StartPoint=construct_point_113, EndPoint=construct_point_114)
line_264 = Line(StartPoint=construct_point_115, EndPoint=construct_point_117)
line_265 = Line(StartPoint=construct_point_116, EndPoint=construct_point_118)
line_266 = Line(StartPoint=construct_point_119, EndPoint=construct_point_120)

# ----
# VERTICAL LINES
line_267 = Line(StartPoint=construct_point_93, EndPoint=construct_point_94)
line_268 = Line(StartPoint=construct_point_95, EndPoint=construct_point_97)
line_269 = Line(StartPoint=construct_point_96, EndPoint=construct_point_98)
line_270 = Line(StartPoint=construct_point_99, EndPoint=construct_point_100)

# ----
# P1
construct_point_125 = ConstructPoint(XCoordinate=Slider(-70, range=-70..40), YCoordinate=number_slider, ZCoordinate=number_slider_116)

# ----
# P1
construct_point_126 = ConstructPoint(XCoordinate=number_slider_123, YCoordinate=number_slider, ZCoordinate=number_slider_117)

# ----
# P1
construct_point_127 = ConstructPoint(XCoordinate=Slider(-70, range=-70..40), YCoordinate=number_slider, ZCoordinate=number_slider_118)

# ----
# P2
construct_point_128 = ConstructPoint(XCoordinate=Slider(-70, range=-70..40), YCoordinate=number_slider_2, ZCoordinate=number_slider_116)

# ----
# P3
construct_point_129 = ConstructPoint(XCoordinate=Slider(-35, range=-70..40), YCoordinate=number_slider, ZCoordinate=number_slider_116)

# ----
# P2
construct_point_130 = ConstructPoint(XCoordinate=Slider(-70, range=-70..40), YCoordinate=number_slider_2, ZCoordinate=number_slider_117)

# ----
# P3
construct_point_131 = ConstructPoint(XCoordinate=Slider(-35, range=-70..40), YCoordinate=number_slider, ZCoordinate=number_slider_117)

# ----
# P2
construct_point_132 = ConstructPoint(XCoordinate=Slider(-70, range=-70..40), YCoordinate=number_slider_2, ZCoordinate=number_slider_118)

# ----
# P3
construct_point_133 = ConstructPoint(XCoordinate=Slider(-35, range=-70..40), YCoordinate=number_slider, ZCoordinate=number_slider_118)

# ----
# P4
construct_point_134 = ConstructPoint(XCoordinate=Slider(-35, range=-70..40), YCoordinate=number_slider_2, ZCoordinate=number_slider_116)

# ----
# P4
construct_point_135 = ConstructPoint(XCoordinate=Slider(-35, range=-70..40), YCoordinate=number_slider_2, ZCoordinate=number_slider_117)

# ----
# P4
construct_point_136 = ConstructPoint(XCoordinate=Slider(-35, range=-70..40), YCoordinate=number_slider_2, ZCoordinate=number_slider_118)

# ----
# P1
construct_point_137 = ConstructPoint(XCoordinate=Slider(-70, range=-70..40), YCoordinate=number_slider, ZCoordinate=number_slider_119)

# ----
# P1
construct_point_138 = ConstructPoint(XCoordinate=Slider(-70, range=-70..40), YCoordinate=number_slider, ZCoordinate=number_slider_120)

# ----
# P2
construct_point_139 = ConstructPoint(XCoordinate=Slider(-70, range=-70..40), YCoordinate=number_slider_2, ZCoordinate=number_slider_119)

# ----
# P3
construct_point_140 = ConstructPoint(XCoordinate=Slider(-35, range=-70..40), YCoordinate=number_slider, ZCoordinate=number_slider_119)

# ----
# P2
construct_point_141 = ConstructPoint(XCoordinate=Slider(-70, range=-70..40), YCoordinate=number_slider_2, ZCoordinate=number_slider_120)

# ----
# P3
construct_point_142 = ConstructPoint(XCoordinate=Slider(-35, range=-70..40), YCoordinate=number_slider, ZCoordinate=number_slider_120)

# ----
# P4
construct_point_143 = ConstructPoint(XCoordinate=Slider(-35, range=-70..40), YCoordinate=number_slider_2, ZCoordinate=number_slider_119)

# ----
# P4
construct_point_144 = ConstructPoint(XCoordinate=Slider(-35, range=-70..40), YCoordinate=number_slider_2, ZCoordinate=number_slider_120)

# ----
# BASE LINES
line_271 = Line(StartPoint=construct_point_121, EndPoint=construct_point_122)
line_272 = Line(StartPoint=construct_point_123, EndPoint=construct_point_121)
line_273 = Line(StartPoint=construct_point_122, EndPoint=construct_point_124)
line_274 = Line(StartPoint=construct_point_124, EndPoint=construct_point_123)
line_275 = Line(StartPoint=construct_point_125, EndPoint=construct_point_128)
line_276 = Line(StartPoint=construct_point_129, EndPoint=construct_point_125)
line_277 = Line(StartPoint=construct_point_128, EndPoint=construct_point_134)
line_278 = Line(StartPoint=construct_point_134, EndPoint=construct_point_129)

line_279 = Line(StartPoint=construct_point_126, EndPoint=construct_point_130)
line_280 = Line(StartPoint=construct_point_131, EndPoint=construct_point_126)
line_281 = Line(StartPoint=construct_point_130, EndPoint=construct_point_135)
line_282 = Line(StartPoint=construct_point_135, EndPoint=construct_point_131)
line_283 = Line(StartPoint=construct_point_127, EndPoint=construct_point_132)
line_284 = Line(StartPoint=construct_point_133, EndPoint=construct_point_127)
line_285 = Line(StartPoint=construct_point_132, EndPoint=construct_point_136)
line_286 = Line(StartPoint=construct_point_136, EndPoint=construct_point_133)

# ----
# BASE LINES
line_287 = Line(StartPoint=construct_point_137, EndPoint=construct_point_139)
line_288 = Line(StartPoint=construct_point_140, EndPoint=construct_point_137)
line_289 = Line(StartPoint=construct_point_139, EndPoint=construct_point_143)
line_290 = Line(StartPoint=construct_point_143, EndPoint=construct_point_140)
line_291 = Line(StartPoint=construct_point_138, EndPoint=construct_point_141)
line_292 = Line(StartPoint=construct_point_142, EndPoint=construct_point_138)
line_293 = Line(StartPoint=construct_point_141, EndPoint=construct_point_144)
line_294 = Line(StartPoint=construct_point_144, EndPoint=construct_point_142)

# ----
# DIAGONAL LINES
line_295 = Line(StartPoint=construct_point_121, EndPoint=construct_point_128)
line_296 = Line(StartPoint=construct_point_122, EndPoint=construct_point_125)
line_297 = Line(StartPoint=construct_point_121, EndPoint=construct_point_129)
line_298 = Line(StartPoint=construct_point_122, EndPoint=construct_point_134)
line_299 = Line(StartPoint=construct_point_124, EndPoint=construct_point_129)
line_300 = Line(StartPoint=construct_point_123, EndPoint=construct_point_134)

line_301 = Line(StartPoint=construct_point_126, EndPoint=construct_point_132)
line_302 = Line(StartPoint=construct_point_130, EndPoint=construct_point_127)
line_303 = Line(StartPoint=construct_point_126, EndPoint=construct_point_133)
line_304 = Line(StartPoint=construct_point_130, EndPoint=construct_point_136)
line_305 = Line(StartPoint=construct_point_135, EndPoint=construct_point_133)
line_306 = Line(StartPoint=construct_point_131, EndPoint=construct_point_136)

# ----
# DIAGONAL LINES
line_307 = Line(StartPoint=construct_point_137, EndPoint=construct_point_141)
line_308 = Line(StartPoint=construct_point_139, EndPoint=construct_point_138)
line_309 = Line(StartPoint=construct_point_137, EndPoint=construct_point_142)
line_310 = Line(StartPoint=construct_point_139, EndPoint=construct_point_144)
line_311 = Line(StartPoint=construct_point_143, EndPoint=construct_point_142)
line_312 = Line(StartPoint=construct_point_140, EndPoint=construct_point_144)

pt = ConstructPoint(
    XCoordinate=Slider(-35, range=-70..20),
    YCoordinate=Slider(130, range=-100..130),
    ZCoordinate=Slider(50, range=-100..100))
pt_2 = ConstructPoint(
    XCoordinate=Slider(-15, range=-70..20),
    YCoordinate=Slider(130, range=-100..130),
    ZCoordinate=Slider(50, range=-100..100))
pt_3 = ConstructPoint(
    XCoordinate=Slider(-35, range=-70..20),
    YCoordinate=Slider(110, range=-100..130),
    ZCoordinate=Slider(50, range=-100..100))
pt_4 = ConstructPoint(
    XCoordinate=Slider(-15, range=-70..20),
    YCoordinate=Slider(110, range=-100..130),
    ZCoordinate=Slider(50, range=-100..100))

pt_5 = ConstructPoint(
    XCoordinate=Slider(-35, range=-70..20),
    YCoordinate=Slider(130, range=-100..130),
    ZCoordinate=Slider(60, range=-100..100))
pt_6 = ConstructPoint(
    XCoordinate=Slider(-15, range=-70..20),
    YCoordinate=Slider(130, range=-100..130),
    ZCoordinate=Slider(60, range=-100..100))
pt_7 = ConstructPoint(
    XCoordinate=Slider(-35, range=-70..20),
    YCoordinate=Slider(110, range=-100..130),
    ZCoordinate=Slider(60, range=-100..100))
pt_8 = ConstructPoint(
    XCoordinate=Slider(-15, range=-70..20),
    YCoordinate=Slider(110, range=-100..130),
    ZCoordinate=Slider(60, range=-100..100))

pt_9 = ConstructPoint(XCoordinate=Slider(-35, range=-70..20), YCoordinate=Slider(20, range=-100..100), ZCoordinate=Slider(50, range=-100..100))
pt_10 = ConstructPoint(XCoordinate=Slider(-15, range=-70..20), YCoordinate=Slider(20, range=-100..100), ZCoordinate=Slider(50, range=-100..100))
pt_11 = ConstructPoint(XCoordinate=Slider(-35, range=-70..20), YCoordinate=Slider(0, range=-100..100), ZCoordinate=Slider(50, range=-100..100))
pt_12 = ConstructPoint(XCoordinate=Slider(-15, range=-70..20), YCoordinate=Slider(0, range=-100..100), ZCoordinate=Slider(50, range=-100..100))

pt_13 = ConstructPoint(XCoordinate=Slider(-35, range=-70..20), YCoordinate=Slider(20, range=-100..100), ZCoordinate=Slider(60, range=-100..100))
pt_14 = ConstructPoint(XCoordinate=Slider(-15, range=-70..20), YCoordinate=Slider(20, range=-100..100), ZCoordinate=Slider(60, range=-100..100))
pt_15 = ConstructPoint(XCoordinate=Slider(-35, range=-70..20), YCoordinate=Slider(0, range=-100..100), ZCoordinate=Slider(60, range=-100..100))
pt_16 = ConstructPoint(XCoordinate=Slider(-15, range=-70..20), YCoordinate=Slider(0, range=-100..100), ZCoordinate=Slider(60, range=-100..100))

# ----
# VERTICAL LINES
line_313 = Line(StartPoint=construct_point_121, EndPoint=construct_point_125)
line_314 = Line(StartPoint=construct_point_122, EndPoint=construct_point_128)
line_315 = Line(StartPoint=construct_point_123, EndPoint=construct_point_129)
line_316 = Line(StartPoint=construct_point_124, EndPoint=construct_point_134)

line_317 = Line(StartPoint=construct_point_126, EndPoint=construct_point_127)
line_318 = Line(StartPoint=construct_point_130, EndPoint=construct_point_132)
line_319 = Line(StartPoint=construct_point_131, EndPoint=construct_point_133)
line_320 = Line(StartPoint=construct_point_135, EndPoint=construct_point_136)

# ----
# VERTICAL LINES
line_321 = Line(StartPoint=construct_point_137, EndPoint=construct_point_138)
line_322 = Line(StartPoint=construct_point_139, EndPoint=construct_point_141)
line_323 = Line(StartPoint=construct_point_140, EndPoint=construct_point_142)
line_324 = Line(StartPoint=construct_point_143, EndPoint=construct_point_144)

pt_17 = ConstructPoint(XCoordinate=Slider(-35, range=-70..20), YCoordinate=number_slider_2, ZCoordinate=Slider(50, range=-100..100))
pt_18 = ConstructPoint(XCoordinate=Slider(-15, range=-70..20), YCoordinate=number_slider_2, ZCoordinate=Slider(50, range=-100..100))
pt_19 = ConstructPoint(XCoordinate=Slider(-35, range=-70..20), YCoordinate=number_slider, ZCoordinate=Slider(50, range=-100..100))
pt_20 = ConstructPoint(XCoordinate=Slider(-15, range=-70..20), YCoordinate=number_slider, ZCoordinate=Slider(50, range=-100..100))

pt_21 = ConstructPoint(XCoordinate=Slider(-35, range=-70..20), YCoordinate=number_slider_2, ZCoordinate=Slider(60, range=-100..100))
pt_22 = ConstructPoint(XCoordinate=Slider(-15, range=-70..20), YCoordinate=number_slider_2, ZCoordinate=Slider(60, range=-100..100))
pt_23 = ConstructPoint(XCoordinate=Slider(-35, range=-70..20), YCoordinate=number_slider, ZCoordinate=Slider(60, range=-100..100))
pt_24 = ConstructPoint(XCoordinate=Slider(-15, range=-70..20), YCoordinate=number_slider, ZCoordinate=Slider(60, range=-100..100))

ln = Line(StartPoint=pt_6, EndPoint=construct_point_21)
ln_2 = Line(StartPoint=pt_5, EndPoint=construct_point_118)
ln_3 = Line(StartPoint=pt_5, EndPoint=pt_8)
ln_4 = Line(StartPoint=pt_6, EndPoint=pt_7)
ln_5 = Line(StartPoint=pt_7, EndPoint=construct_point_120)
ln_6 = Line(StartPoint=pt_7, EndPoint=pt_4)
ln_7 = Line(StartPoint=pt_8, EndPoint=construct_point_34)
ln_8 = Line(StartPoint=pt_5, EndPoint=pt_2)
ln_9 = Line(StartPoint=pt_8, EndPoint=pt_3)
ln_10 = Line(StartPoint=pt_6, EndPoint=pt)
ln_11 = Line(StartPoint=pt, EndPoint=construct_point_116)
ln_12 = Line(StartPoint=pt_2, EndPoint=pt_3)
ln_13 = Line(StartPoint=pt_3, EndPoint=construct_point_119)
ln_14 = Line(StartPoint=pt_4, EndPoint=pt)
ln_15 = Line(StartPoint=pt_4, EndPoint=construct_point_27)
ln_16 = Line(StartPoint=pt_2, EndPoint=construct_point_22)
ln_17 = Line(StartPoint=pt_3, EndPoint=construct_point_118)
ln_18 = Line(StartPoint=pt, EndPoint=construct_point_120)
ln_19 = Line(StartPoint=construct_point_21, EndPoint=pt_4)
ln_20 = Line(StartPoint=construct_point_34, EndPoint=pt_2)
ln_21 = Line(StartPoint=pt_14, EndPoint=construct_point_42)
ln_22 = Line(StartPoint=pt_13, EndPoint=construct_point_98)
ln_23 = Line(StartPoint=pt_13, EndPoint=pt_16)
ln_24 = Line(StartPoint=pt_14, EndPoint=pt_15)
ln_25 = Line(StartPoint=pt_15, EndPoint=construct_point_100)
ln_26 = Line(StartPoint=pt_15, EndPoint=pt_12)
ln_27 = Line(StartPoint=pt_16, EndPoint=construct_point_46)
ln_28 = Line(StartPoint=pt_13, EndPoint=pt_10)
ln_29 = Line(StartPoint=pt_16, EndPoint=pt_11)
ln_30 = Line(StartPoint=pt_14, EndPoint=pt_9)
ln_31 = Line(StartPoint=pt_9, EndPoint=construct_point_96)
ln_32 = Line(StartPoint=pt_10, EndPoint=pt_11)
ln_33 = Line(StartPoint=pt_11, EndPoint=construct_point_99)
ln_34 = Line(StartPoint=pt_12, EndPoint=pt_9)
ln_35 = Line(StartPoint=pt_12, EndPoint=construct_point_43)
ln_36 = Line(StartPoint=pt_10, EndPoint=construct_point_41)
ln_37 = Line(StartPoint=pt_11, EndPoint=construct_point_98)
ln_38 = Line(StartPoint=pt_9, EndPoint=construct_point_100)
ln_39 = Line(StartPoint=construct_point_42, EndPoint=pt_12)
ln_40 = Line(StartPoint=construct_point_46, EndPoint=pt_10)
number_slider_126 = Slider(205, range=0..240)
number_slider_127 = Slider(190, range=0..240)
number_slider_128 = Slider(175, range=0..240)
number_slider_129 = Slider(160, range=0..240)
number_slider_130 = Slider(145, range=0..240)
ln_41 = Line(StartPoint=pt_22, EndPoint=construct_point_66)
ln_42 = Line(StartPoint=pt_21, EndPoint=construct_point_142)
ln_43 = Line(StartPoint=pt_21, EndPoint=pt_24)
ln_44 = Line(StartPoint=pt_22, EndPoint=pt_23)
ln_45 = Line(StartPoint=pt_23, EndPoint=construct_point_144)
ln_46 = Line(StartPoint=pt_23, EndPoint=pt_20)
ln_47 = Line(StartPoint=pt_24, EndPoint=construct_point_70)
ln_48 = Line(StartPoint=pt_21, EndPoint=pt_18)
ln_49 = Line(StartPoint=pt_24, EndPoint=pt_19)
ln_50 = Line(StartPoint=pt_22, EndPoint=pt_17)
ln_51 = Line(StartPoint=pt_17, EndPoint=construct_point_140)
ln_52 = Line(StartPoint=pt_18, EndPoint=pt_19)
ln_53 = Line(StartPoint=pt_19, EndPoint=construct_point_143)
ln_54 = Line(StartPoint=pt_20, EndPoint=pt_17)
ln_55 = Line(StartPoint=pt_20, EndPoint=construct_point_67)
ln_56 = Line(StartPoint=pt_18, EndPoint=construct_point_65)
ln_57 = Line(StartPoint=pt_19, EndPoint=construct_point_142)
ln_58 = Line(StartPoint=pt_17, EndPoint=construct_point_144)
ln_59 = Line(StartPoint=construct_point_66, EndPoint=pt_20)
ln_60 = Line(StartPoint=construct_point_70, EndPoint=pt_18)
pt_25 = ConstructPoint(XCoordinate=Slider(-70, range=-70..20), YCoordinate=Slider(35, range=-100..130), ZCoordinate=Slider(60, range=-100..100))
pt_26 = ConstructPoint(XCoordinate=Slider(-70, range=-70..20), YCoordinate=Slider(95, range=-100..130), ZCoordinate=Slider(60, range=-100..100))
pt_27 = ConstructPoint(XCoordinate=Slider(-70, range=-70..20), YCoordinate=Slider(80, range=-100..130), ZCoordinate=Slider(60, range=-100..100))
pt_28 = ConstructPoint(XCoordinate=Slider(-70, range=-70..20), YCoordinate=Slider(65, range=-100..130), ZCoordinate=Slider(60, range=-100..100))
pt_29 = ConstructPoint(XCoordinate=Slider(-70, range=-70..20), YCoordinate=Slider(50, range=-100..130), ZCoordinate=Slider(60, range=-100..100))
pt_30 = ConstructPoint(XCoordinate=Slider(-70, range=-70..20), YCoordinate=Slider(35, range=-100..130), ZCoordinate=Slider(50, range=-100..100))
pt_31 = ConstructPoint(XCoordinate=Slider(-70, range=-70..20), YCoordinate=Slider(95, range=-100..130), ZCoordinate=Slider(50, range=-100..100))
pt_32 = ConstructPoint(XCoordinate=Slider(-70, range=-70..20), YCoordinate=Slider(80, range=-100..130), ZCoordinate=Slider(50, range=-100..100))
pt_33 = ConstructPoint(XCoordinate=Slider(-70, range=-70..20), YCoordinate=Slider(65, range=-100..130), ZCoordinate=Slider(50, range=-100..100))
pt_34 = ConstructPoint(XCoordinate=Slider(-70, range=-70..20), YCoordinate=Slider(50, range=-100..130), ZCoordinate=Slider(50, range=-100..100))
pt_35 = ConstructPoint(XCoordinate=Slider(0, range=-70..20), YCoordinate=Slider(35, range=-100..130), ZCoordinate=Slider(60, range=-100..100))
pt_36 = ConstructPoint(XCoordinate=Slider(0, range=-70..20), YCoordinate=Slider(95, range=-100..130), ZCoordinate=Slider(60, range=-100..100))
pt_37 = ConstructPoint(XCoordinate=Slider(0, range=-70..20), YCoordinate=Slider(80, range=-100..130), ZCoordinate=Slider(60, range=-100..100))
pt_38 = ConstructPoint(XCoordinate=Slider(0, range=-70..20), YCoordinate=Slider(65, range=-100..130), ZCoordinate=Slider(60, range=-100..100))
pt_39 = ConstructPoint(XCoordinate=Slider(0, range=-70..20), YCoordinate=Slider(50, range=-100..130), ZCoordinate=Slider(60, range=-100..100))
pt_40 = ConstructPoint(XCoordinate=Slider(0, range=-70..20), YCoordinate=Slider(35, range=-100..130), ZCoordinate=Slider(50, range=-100..100))
pt_41 = ConstructPoint(XCoordinate=Slider(0, range=-70..20), YCoordinate=Slider(95, range=-100..130), ZCoordinate=Slider(50, range=-100..100))
pt_42 = ConstructPoint(XCoordinate=Slider(0, range=-70..20), YCoordinate=Slider(80, range=-100..130), ZCoordinate=Slider(50, range=-100..100))
pt_43 = ConstructPoint(XCoordinate=Slider(0, range=-70..20), YCoordinate=Slider(65, range=-100..130), ZCoordinate=Slider(50, range=-100..100))
pt_44 = ConstructPoint(XCoordinate=Slider(0, range=-70..20), YCoordinate=Slider(50, range=-100..130), ZCoordinate=Slider(50, range=-100..100))
pt_45 = ConstructPoint(XCoordinate=Slider(-35, range=-70..20), YCoordinate=Slider(35, range=-100..130), ZCoordinate=Slider(60, range=-100..100))
pt_46 = ConstructPoint(XCoordinate=Slider(-35, range=-70..20), YCoordinate=Slider(95, range=-100..130), ZCoordinate=Slider(60, range=-100..100))
pt_47 = ConstructPoint(XCoordinate=Slider(-35, range=-70..20), YCoordinate=Slider(80, range=-100..130), ZCoordinate=Slider(60, range=-100..100))
pt_48 = ConstructPoint(XCoordinate=Slider(-35, range=-70..20), YCoordinate=Slider(65, range=-100..130), ZCoordinate=Slider(60, range=-100..100))
pt_49 = ConstructPoint(XCoordinate=Slider(-35, range=-70..20), YCoordinate=Slider(50, range=-100..130), ZCoordinate=Slider(60, range=-100..100))
pt_50 = ConstructPoint(XCoordinate=Slider(-35, range=-70..20), YCoordinate=Slider(35, range=-100..130), ZCoordinate=Slider(50, range=-100..100))
pt_51 = ConstructPoint(XCoordinate=Slider(-35, range=-70..20), YCoordinate=Slider(95, range=-100..130), ZCoordinate=Slider(50, range=-100..100))
pt_52 = ConstructPoint(XCoordinate=Slider(-35, range=-70..20), YCoordinate=Slider(80, range=-100..130), ZCoordinate=Slider(50, range=-100..100))
pt_53 = ConstructPoint(XCoordinate=Slider(-35, range=-70..20), YCoordinate=Slider(65, range=-100..130), ZCoordinate=Slider(50, range=-100..100))
pt_54 = ConstructPoint(XCoordinate=Slider(-35, range=-70..20), YCoordinate=Slider(50, range=-100..130), ZCoordinate=Slider(50, range=-100..100))
pt_55 = ConstructPoint(XCoordinate=Slider(20, range=-70..20), YCoordinate=Slider(35, range=-100..130), ZCoordinate=Slider(60, range=-100..100))
pt_56 = ConstructPoint(XCoordinate=Slider(20, range=-70..20), YCoordinate=Slider(95, range=-100..130), ZCoordinate=Slider(60, range=-100..100))
pt_57 = ConstructPoint(XCoordinate=Slider(20, range=-70..20), YCoordinate=Slider(80, range=-100..130), ZCoordinate=Slider(60, range=-100..100))
pt_58 = ConstructPoint(XCoordinate=Slider(20, range=-70..20), YCoordinate=Slider(65, range=-100..130), ZCoordinate=Slider(60, range=-100..100))
pt_59 = ConstructPoint(XCoordinate=Slider(20, range=-70..20), YCoordinate=Slider(50, range=-100..130), ZCoordinate=Slider(60, range=-100..100))
pt_60 = ConstructPoint(XCoordinate=Slider(20, range=-70..20), YCoordinate=Slider(35, range=-100..130), ZCoordinate=Slider(50, range=-100..100))
pt_61 = ConstructPoint(XCoordinate=Slider(20, range=-70..20), YCoordinate=Slider(95, range=-100..130), ZCoordinate=Slider(50, range=-100..100))
pt_62 = ConstructPoint(XCoordinate=Slider(20, range=-70..20), YCoordinate=Slider(80, range=-100..130), ZCoordinate=Slider(50, range=-100..100))
pt_63 = ConstructPoint(XCoordinate=Slider(20, range=-70..20), YCoordinate=Slider(65, range=-100..130), ZCoordinate=Slider(50, range=-100..100))
pt_64 = ConstructPoint(XCoordinate=Slider(20, range=-70..20), YCoordinate=Slider(50, range=-100..130), ZCoordinate=Slider(50, range=-100..100))
pt_65 = ConstructPoint(XCoordinate=Slider(-70, range=-70..20), YCoordinate=number_slider_130, ZCoordinate=Slider(60, range=-100..100))
pt_66 = ConstructPoint(XCoordinate=Slider(-70, range=-70..20), YCoordinate=number_slider_126, ZCoordinate=Slider(60, range=-100..100))
pt_67 = ConstructPoint(XCoordinate=Slider(-70, range=-70..20), YCoordinate=number_slider_127, ZCoordinate=Slider(60, range=-100..100))
pt_68 = ConstructPoint(XCoordinate=Slider(-70, range=-70..20), YCoordinate=number_slider_128, ZCoordinate=Slider(60, range=-100..100))
pt_69 = ConstructPoint(XCoordinate=Slider(-70, range=-70..20), YCoordinate=number_slider_129, ZCoordinate=Slider(60, range=-100..100))
pt_70 = ConstructPoint(XCoordinate=Slider(-70, range=-70..20), YCoordinate=number_slider_130, ZCoordinate=Slider(50, range=-100..100))
pt_71 = ConstructPoint(XCoordinate=Slider(-70, range=-70..20), YCoordinate=number_slider_126, ZCoordinate=Slider(50, range=-100..100))
pt_72 = ConstructPoint(XCoordinate=Slider(-70, range=-70..20), YCoordinate=number_slider_127, ZCoordinate=Slider(50, range=-100..100))
pt_73 = ConstructPoint(XCoordinate=Slider(-70, range=-70..20), YCoordinate=number_slider_128, ZCoordinate=Slider(50, range=-100..100))
pt_74 = ConstructPoint(XCoordinate=Slider(-70, range=-70..20), YCoordinate=number_slider_129, ZCoordinate=Slider(50, range=-100..100))
ln_61 = Line(StartPoint=pt_46, EndPoint=construct_point_114)
ln_62 = Line(StartPoint=pt_26, EndPoint=construct_point_118)
ln_63 = Line(StartPoint=pt_47, EndPoint=pt_26)
ln_64 = Line(StartPoint=pt_27, EndPoint=pt_46)
ln_65 = Line(StartPoint=pt_28, EndPoint=pt_47)
ln_66 = Line(StartPoint=pt_48, EndPoint=pt_27)
ln_67 = Line(StartPoint=pt_29, EndPoint=pt_48)
ln_68 = Line(StartPoint=pt_49, EndPoint=pt_28)
ln_69 = Line(StartPoint=pt_25, EndPoint=pt_49)
ln_70 = Line(StartPoint=pt_45, EndPoint=pt_29)
ln_71 = Line(StartPoint=pt_45, EndPoint=construct_point_97)
ln_72 = Line(StartPoint=pt_25, EndPoint=construct_point_100)
ln_73 = Line(StartPoint=construct_point_95, EndPoint=pt_50)
ln_74 = Line(StartPoint=pt_30, EndPoint=construct_point_99)
ln_75 = Line(StartPoint=pt_33, EndPoint=pt_52)
ln_76 = Line(StartPoint=pt_53, EndPoint=pt_32)
ln_77 = Line(StartPoint=pt_34, EndPoint=pt_53)
ln_78 = Line(StartPoint=pt_54, EndPoint=pt_33)
ln_79 = Line(StartPoint=pt_50, EndPoint=pt_34)
ln_80 = Line(StartPoint=pt_30, EndPoint=pt_54)
ln_81 = Line(StartPoint=pt_32, EndPoint=pt_51)
ln_82 = Line(StartPoint=pt_52, EndPoint=pt_31)
ln_83 = Line(StartPoint=pt_31, EndPoint=construct_point_116)
ln_84 = Line(StartPoint=construct_point_113, EndPoint=pt_51)
pt_75 = ConstructPoint(XCoordinate=Slider(0, range=-70..20), YCoordinate=number_slider_130, ZCoordinate=Slider(60, range=-100..100))
pt_76 = ConstructPoint(XCoordinate=Slider(0, range=-70..20), YCoordinate=number_slider_126, ZCoordinate=Slider(60, range=-100..100))
pt_77 = ConstructPoint(XCoordinate=Slider(0, range=-70..20), YCoordinate=number_slider_127, ZCoordinate=Slider(60, range=-100..100))
pt_78 = ConstructPoint(XCoordinate=Slider(0, range=-70..20), YCoordinate=number_slider_128, ZCoordinate=Slider(60, range=-100..100))
pt_79 = ConstructPoint(XCoordinate=Slider(0, range=-70..20), YCoordinate=number_slider_129, ZCoordinate=Slider(60, range=-100..100))
pt_80 = ConstructPoint(XCoordinate=Slider(0, range=-70..20), YCoordinate=number_slider_130, ZCoordinate=Slider(50, range=-100..100))
pt_81 = ConstructPoint(XCoordinate=Slider(0, range=-70..20), YCoordinate=number_slider_126, ZCoordinate=Slider(50, range=-100..100))
pt_82 = ConstructPoint(XCoordinate=Slider(0, range=-70..20), YCoordinate=number_slider_127, ZCoordinate=Slider(50, range=-100..100))
pt_83 = ConstructPoint(XCoordinate=Slider(0, range=-70..20), YCoordinate=number_slider_128, ZCoordinate=Slider(50, range=-100..100))
pt_84 = ConstructPoint(XCoordinate=Slider(0, range=-70..20), YCoordinate=number_slider_129, ZCoordinate=Slider(50, range=-100..100))
ln_85 = Line(StartPoint=pt_56, EndPoint=construct_point_21)
ln_86 = Line(StartPoint=pt_36, EndPoint=construct_point_28)
ln_87 = Line(StartPoint=pt_57, EndPoint=pt_36)
ln_88 = Line(StartPoint=pt_37, EndPoint=pt_56)
ln_89 = Line(StartPoint=pt_38, EndPoint=pt_57)
ln_90 = Line(StartPoint=pt_58, EndPoint=pt_37)
ln_91 = Line(StartPoint=pt_39, EndPoint=pt_58)
ln_92 = Line(StartPoint=pt_59, EndPoint=pt_38)
ln_93 = Line(StartPoint=pt_35, EndPoint=pt_59)
ln_94 = Line(StartPoint=pt_55, EndPoint=pt_39)
ln_95 = Line(StartPoint=pt_55, EndPoint=construct_point_46)
ln_96 = Line(StartPoint=pt_35, EndPoint=construct_point_48)
ln_97 = Line(StartPoint=construct_point_43, EndPoint=pt_60)
ln_98 = Line(StartPoint=pt_40, EndPoint=construct_point_47)
ln_99 = Line(StartPoint=pt_43, EndPoint=pt_62)

ln_100 = Line(StartPoint=pt_63, EndPoint=pt_42)
ln_101 = Line(StartPoint=pt_44, EndPoint=pt_63)

ln_102 = Line(StartPoint=pt_64, EndPoint=pt_43)
ln_103 = Line(StartPoint=pt_60, EndPoint=pt_44)
ln_104 = Line(StartPoint=pt_40, EndPoint=pt_64)
ln_105 = Line(StartPoint=pt_42, EndPoint=pt_61)
ln_106 = Line(StartPoint=pt_62, EndPoint=pt_41)
ln_107 = Line(StartPoint=pt_41, EndPoint=construct_point_21)
ln_108 = Line(StartPoint=construct_point_28, EndPoint=pt_61)
pt_85 = ConstructPoint(XCoordinate=Slider(-35, range=-70..20), YCoordinate=number_slider_130, ZCoordinate=Slider(60, range=-100..100))
pt_86 = ConstructPoint(XCoordinate=Slider(-35, range=-70..20), YCoordinate=number_slider_126, ZCoordinate=Slider(60, range=-100..100))
pt_87 = ConstructPoint(XCoordinate=Slider(-35, range=-70..20), YCoordinate=number_slider_127, ZCoordinate=Slider(60, range=-100..100))
pt_88 = ConstructPoint(XCoordinate=Slider(-35, range=-70..20), YCoordinate=number_slider_128, ZCoordinate=Slider(60, range=-100..100))
pt_89 = ConstructPoint(XCoordinate=Slider(-35, range=-70..20), YCoordinate=number_slider_129, ZCoordinate=Slider(60, range=-100..100))
pt_90 = ConstructPoint(XCoordinate=Slider(-35, range=-70..20), YCoordinate=number_slider_130, ZCoordinate=Slider(50, range=-100..100))
pt_91 = ConstructPoint(XCoordinate=Slider(-35, range=-70..20), YCoordinate=number_slider_126, ZCoordinate=Slider(50, range=-100..100))
pt_92 = ConstructPoint(XCoordinate=Slider(-35, range=-70..20), YCoordinate=number_slider_127, ZCoordinate=Slider(50, range=-100..100))
pt_93 = ConstructPoint(XCoordinate=Slider(-35, range=-70..20), YCoordinate=number_slider_128, ZCoordinate=Slider(50, range=-100..100))
pt_94 = ConstructPoint(XCoordinate=Slider(-35, range=-70..20), YCoordinate=number_slider_129, ZCoordinate=Slider(50, range=-100..100))
ln_109 = Line(StartPoint=pt_46, EndPoint=pt_52)
ln_110 = Line(StartPoint=construct_point_118, EndPoint=pt_51)
ln_111 = Line(StartPoint=pt_47, EndPoint=pt_53)
ln_112 = Line(StartPoint=construct_point_100, EndPoint=pt_50)
ln_113 = Line(StartPoint=construct_point_97, EndPoint=pt_30)
ln_114 = Line(StartPoint=pt_25, EndPoint=pt_34)
ln_115 = Line(StartPoint=pt_29, EndPoint=pt_33)
ln_116 = Line(StartPoint=pt_45, EndPoint=pt_54)
ln_117 = Line(StartPoint=pt_49, EndPoint=pt_53)
ln_118 = Line(StartPoint=pt_27, EndPoint=pt_33)
ln_119 = Line(StartPoint=pt_26, EndPoint=pt_32)
ln_120 = Line(StartPoint=construct_point_114, EndPoint=pt_31)
pt_95 = ConstructPoint(XCoordinate=Slider(20, range=-70..20), YCoordinate=number_slider_130, ZCoordinate=Slider(60, range=-100..100))
pt_96 = ConstructPoint(XCoordinate=Slider(20, range=-70..20), YCoordinate=number_slider_126, ZCoordinate=Slider(60, range=-100..100))
pt_97 = ConstructPoint(XCoordinate=Slider(20, range=-70..20), YCoordinate=number_slider_127, ZCoordinate=Slider(60, range=-100..100))
pt_98 = ConstructPoint(XCoordinate=Slider(20, range=-70..20), YCoordinate=number_slider_128, ZCoordinate=Slider(60, range=-100..100))
pt_99 = ConstructPoint(XCoordinate=Slider(20, range=-70..20), YCoordinate=number_slider_129, ZCoordinate=Slider(60, range=-100..100))
pt_100 = ConstructPoint(XCoordinate=Slider(20, range=-70..20), YCoordinate=number_slider_130, ZCoordinate=Slider(50, range=-100..100))
pt_101 = ConstructPoint(XCoordinate=Slider(20, range=-70..20), YCoordinate=number_slider_126, ZCoordinate=Slider(50, range=-100..100))
pt_102 = ConstructPoint(XCoordinate=Slider(20, range=-70..20), YCoordinate=number_slider_127, ZCoordinate=Slider(50, range=-100..100))
pt_103 = ConstructPoint(XCoordinate=Slider(20, range=-70..20), YCoordinate=number_slider_128, ZCoordinate=Slider(50, range=-100..100))
pt_104 = ConstructPoint(XCoordinate=Slider(20, range=-70..20), YCoordinate=number_slider_129, ZCoordinate=Slider(50, range=-100..100))
ln_121 = Line(StartPoint=pt_56, EndPoint=pt_62)
ln_122 = Line(StartPoint=construct_point_22, EndPoint=pt_61)
ln_123 = Line(StartPoint=pt_57, EndPoint=pt_63)
ln_124 = Line(StartPoint=construct_point_48, EndPoint=pt_60)
ln_125 = Line(StartPoint=construct_point_46, EndPoint=pt_40)
ln_126 = Line(StartPoint=pt_35, EndPoint=pt_44)
ln_127 = Line(StartPoint=pt_39, EndPoint=pt_43)
ln_128 = Line(StartPoint=pt_55, EndPoint=pt_64)
ln_129 = Line(StartPoint=pt_59, EndPoint=pt_63)
ln_130 = Line(StartPoint=pt_37, EndPoint=pt_43)
ln_131 = Line(StartPoint=pt_36, EndPoint=pt_42)
ln_132 = Line(StartPoint=construct_point_33, EndPoint=pt_41)
ln_133 = Line(StartPoint=pt_86, EndPoint=construct_point_138)
ln_134 = Line(StartPoint=pt_66, EndPoint=construct_point_142)
ln_135 = Line(StartPoint=pt_87, EndPoint=pt_66)
ln_136 = Line(StartPoint=pt_67, EndPoint=pt_86)
ln_137 = Line(StartPoint=pt_68, EndPoint=pt_87)
ln_138 = Line(StartPoint=pt_88, EndPoint=pt_67)
ln_139 = Line(StartPoint=pt_69, EndPoint=pt_88)
ln_140 = Line(StartPoint=pt_89, EndPoint=pt_68)
ln_141 = Line(StartPoint=pt_65, EndPoint=pt_89)
ln_142 = Line(StartPoint=pt_85, EndPoint=pt_69)
ln_143 = Line(StartPoint=pt_85, EndPoint=construct_point_117)
ln_144 = Line(StartPoint=pt_65, EndPoint=construct_point_120)
ln_145 = Line(StartPoint=construct_point_115, EndPoint=pt_90)
ln_146 = Line(StartPoint=pt_70, EndPoint=construct_point_119)
ln_147 = Line(StartPoint=pt_73, EndPoint=pt_92)
ln_148 = Line(StartPoint=pt_93, EndPoint=pt_72)
ln_149 = Line(StartPoint=pt_74, EndPoint=pt_93)
ln_150 = Line(StartPoint=pt_94, EndPoint=pt_73)
ln_151 = Line(StartPoint=pt_90, EndPoint=pt_74)
ln_152 = Line(StartPoint=pt_70, EndPoint=pt_94)
ln_153 = Line(StartPoint=pt_72, EndPoint=pt_91)
ln_154 = Line(StartPoint=pt_92, EndPoint=pt_71)
ln_155 = Line(StartPoint=pt_71, EndPoint=construct_point_140)
ln_156 = Line(StartPoint=construct_point_137, EndPoint=pt_91)
ln_157 = Line(StartPoint=pt_96, EndPoint=construct_point_66)
ln_158 = Line(StartPoint=pt_76, EndPoint=construct_point_68)
ln_159 = Line(StartPoint=pt_97, EndPoint=pt_76)
ln_160 = Line(StartPoint=pt_77, EndPoint=pt_96)
ln_161 = Line(StartPoint=pt_78, EndPoint=pt_97)
ln_162 = Line(StartPoint=pt_98, EndPoint=pt_77)
ln_163 = Line(StartPoint=pt_79, EndPoint=pt_98)
ln_164 = Line(StartPoint=pt_99, EndPoint=pt_78)
ln_165 = Line(StartPoint=pt_75, EndPoint=pt_99)
ln_166 = Line(StartPoint=pt_95, EndPoint=pt_79)
ln_167 = Line(StartPoint=pt_95, EndPoint=construct_point_34)
ln_168 = Line(StartPoint=pt_75, EndPoint=construct_point_40)
ln_169 = Line(StartPoint=construct_point_27, EndPoint=pt_100)
ln_170 = Line(StartPoint=pt_80, EndPoint=construct_point_38)
ln_171 = Line(StartPoint=pt_83, EndPoint=pt_102)
ln_172 = Line(StartPoint=pt_103, EndPoint=pt_82)
ln_173 = Line(StartPoint=pt_84, EndPoint=pt_103)
ln_174 = Line(StartPoint=pt_104, EndPoint=pt_83)
ln_175 = Line(StartPoint=pt_100, EndPoint=pt_84)
ln_176 = Line(StartPoint=pt_80, EndPoint=pt_104)
ln_177 = Line(StartPoint=pt_82, EndPoint=pt_101)
ln_178 = Line(StartPoint=pt_102, EndPoint=pt_81)
ln_179 = Line(StartPoint=pt_81, EndPoint=construct_point_66)
ln_180 = Line(StartPoint=construct_point_68, EndPoint=pt_101)
ln_181 = Line(StartPoint=pt_86, EndPoint=pt_92)
ln_182 = Line(StartPoint=construct_point_142, EndPoint=pt_91)
ln_183 = Line(StartPoint=pt_87, EndPoint=pt_93)
ln_184 = Line(StartPoint=construct_point_120, EndPoint=pt_90)
ln_185 = Line(StartPoint=construct_point_117, EndPoint=pt_70)
ln_186 = Line(StartPoint=pt_65, EndPoint=pt_74)
ln_187 = Line(StartPoint=pt_69, EndPoint=pt_73)
ln_188 = Line(StartPoint=pt_85, EndPoint=pt_94)
ln_189 = Line(StartPoint=pt_89, EndPoint=pt_93)
ln_190 = Line(StartPoint=pt_67, EndPoint=pt_73)
ln_191 = Line(StartPoint=pt_66, EndPoint=pt_72)
ln_192 = Line(StartPoint=construct_point_138, EndPoint=pt_71)
ln_193 = Line(StartPoint=pt_96, EndPoint=pt_102)
ln_194 = Line(StartPoint=construct_point_65, EndPoint=pt_101)
ln_195 = Line(StartPoint=pt_97, EndPoint=pt_103)
ln_196 = Line(StartPoint=construct_point_40, EndPoint=pt_100)
ln_197 = Line(StartPoint=construct_point_34, EndPoint=pt_80)
ln_198 = Line(StartPoint=pt_75, EndPoint=pt_84)
ln_199 = Line(StartPoint=pt_79, EndPoint=pt_83)
ln_200 = Line(StartPoint=pt_95, EndPoint=pt_104)
ln_201 = Line(StartPoint=pt_99, EndPoint=pt_103)
ln_202 = Line(StartPoint=pt_77, EndPoint=pt_83)
ln_203 = Line(StartPoint=pt_76, EndPoint=pt_82)
ln_204 = Line(StartPoint=construct_point_69, EndPoint=pt_81)
merge = Merge(
    Data1=ln_61,
    Data2=ln_62,
    Data3=ln_63,
    Data4=ln_64,
    Data5=ln_65,
    Data6=ln_66,
    Data7=ln_67,
    Data8=ln_68,
    Data9=ln_69,
    Data10=ln_70,
    Data11=ln_71,
    Data12=ln_72,
    Data13=ln_73,
    Data14=ln_74,
    Data15=ln_75,
    Data16=ln_76,
    Data17=ln_77,
    Data18=ln_78,
    Data19=ln_79,
    Data20=ln_80,
    Data21=ln_81,
    Data22=ln_82,
    Data23=ln_83,
    Data24=ln_84,
    Data25=ln_109,
    Data26=ln_110,
    Data27=ln_111,
    Data28=ln_112,
    Data29=ln_113,
    Data30=ln_114,
    Data31=ln_115,
    Data32=ln_116,
    Data33=ln_117,
    Data34=ln_118,
    Data35=ln_119,
    Data36=ln_120)
Z = UnitZ(Factor=Slider(40, range=0..50))
mirror = Mirror(Geometry=merge, Plane=Z)  # -> Geometry, Transform
yz = YZPlane(Origin="10,0")
mirror_2 = Mirror(Geometry=mirror.Geometry, Plane=yz)  # -> Geometry, Transform
xz = XZPlane(Origin="10,120")
pt_105 = ConstructPoint(XCoordinate=Slider(0, range=-70..20), YCoordinate=number_slider_130, ZCoordinate=Slider(30, range=-100..100))
pt_106 = ConstructPoint(XCoordinate=Slider(0, range=-70..20), YCoordinate=number_slider_126, ZCoordinate=Slider(30, range=-100..100))
pt_107 = ConstructPoint(XCoordinate=Slider(0, range=-70..20), YCoordinate=number_slider_127, ZCoordinate=Slider(30, range=-100..100))
pt_108 = ConstructPoint(XCoordinate=Slider(0, range=-70..20), YCoordinate=number_slider_128, ZCoordinate=Slider(30, range=-100..100))
pt_109 = ConstructPoint(XCoordinate=Slider(0, range=-70..20), YCoordinate=number_slider_129, ZCoordinate=Slider(30, range=-100..100))
pt_110 = ConstructPoint(XCoordinate=Slider(0, range=-70..20), YCoordinate=number_slider_130, ZCoordinate=Slider(20, range=-100..100))
pt_111 = ConstructPoint(XCoordinate=Slider(0, range=-70..20), YCoordinate=number_slider_126, ZCoordinate=Slider(20, range=-100..100))
pt_112 = ConstructPoint(XCoordinate=Slider(0, range=-70..20), YCoordinate=number_slider_127, ZCoordinate=Slider(20, range=-100..100))
pt_113 = ConstructPoint(XCoordinate=Slider(0, range=-70..20), YCoordinate=number_slider_128, ZCoordinate=Slider(20, range=-100..100))
pt_114 = ConstructPoint(XCoordinate=Slider(0, range=-70..20), YCoordinate=number_slider_129, ZCoordinate=Slider(20, range=-100..100))
mirror_3 = Mirror(Geometry=[mirror.Geometry, mirror_2.Geometry], Plane=xz)  # -> Geometry, Transform

pt_115 = ConstructPoint(XCoordinate=Slider(-35, range=-70..20), YCoordinate=number_slider_2, ZCoordinate=Slider(20, range=-100..100))
pt_116 = ConstructPoint(XCoordinate=Slider(-15, range=-70..20), YCoordinate=number_slider_2, ZCoordinate=Slider(20, range=-100..100))
pt_117 = ConstructPoint(XCoordinate=Slider(-35, range=-70..20), YCoordinate=number_slider, ZCoordinate=Slider(20, range=-100..100))
pt_118 = ConstructPoint(XCoordinate=Slider(-15, range=-70..20), YCoordinate=number_slider, ZCoordinate=Slider(20, range=-100..100))

pt_119 = ConstructPoint(XCoordinate=Slider(-35, range=-70..20), YCoordinate=number_slider_2, ZCoordinate=Slider(30, range=-100..100))
pt_120 = ConstructPoint(XCoordinate=Slider(-15, range=-70..20), YCoordinate=number_slider_2, ZCoordinate=Slider(30, range=-100..100))
pt_121 = ConstructPoint(XCoordinate=Slider(-35, range=-70..20), YCoordinate=number_slider, ZCoordinate=Slider(30, range=-100..100))
pt_122 = ConstructPoint(XCoordinate=Slider(-15, range=-70..20), YCoordinate=number_slider, ZCoordinate=Slider(30, range=-100..100))

pt_123 = ConstructPoint(XCoordinate=Slider(20, range=-70..20), YCoordinate=number_slider_130, ZCoordinate=Slider(30, range=-100..100))
pt_124 = ConstructPoint(XCoordinate=Slider(20, range=-70..20), YCoordinate=number_slider_126, ZCoordinate=Slider(30, range=-100..100))
pt_125 = ConstructPoint(XCoordinate=Slider(20, range=-70..20), YCoordinate=number_slider_127, ZCoordinate=Slider(30, range=-100..100))
pt_126 = ConstructPoint(XCoordinate=Slider(20, range=-70..20), YCoordinate=number_slider_128, ZCoordinate=Slider(30, range=-100..100))
pt_127 = ConstructPoint(XCoordinate=Slider(20, range=-70..20), YCoordinate=number_slider_129, ZCoordinate=Slider(30, range=-100..100))
pt_128 = ConstructPoint(XCoordinate=Slider(20, range=-70..20), YCoordinate=number_slider_130, ZCoordinate=Slider(20, range=-100..100))
pt_129 = ConstructPoint(XCoordinate=Slider(20, range=-70..20), YCoordinate=number_slider_126, ZCoordinate=Slider(20, range=-100..100))
pt_130 = ConstructPoint(XCoordinate=Slider(20, range=-70..20), YCoordinate=number_slider_127, ZCoordinate=Slider(20, range=-100..100))
pt_131 = ConstructPoint(XCoordinate=Slider(20, range=-70..20), YCoordinate=number_slider_128, ZCoordinate=Slider(20, range=-100..100))
pt_132 = ConstructPoint(XCoordinate=Slider(20, range=-70..20), YCoordinate=number_slider_129, ZCoordinate=Slider(20, range=-100..100))
ln_205 = Line(StartPoint=pt_120, EndPoint=construct_point_52)
ln_206 = Line(StartPoint=pt_119, EndPoint=construct_point_140)
ln_207 = Line(StartPoint=pt_119, EndPoint=pt_122)
ln_208 = Line(StartPoint=pt_120, EndPoint=pt_121)
ln_209 = Line(StartPoint=pt_121, EndPoint=construct_point_143)
ln_210 = Line(StartPoint=pt_121, EndPoint=pt_118)
ln_211 = Line(StartPoint=pt_122, EndPoint=construct_point_67)
ln_212 = Line(StartPoint=pt_119, EndPoint=pt_116)
ln_213 = Line(StartPoint=pt_122, EndPoint=pt_117)
ln_214 = Line(StartPoint=pt_120, EndPoint=pt_115)
ln_215 = Line(StartPoint=pt_115, EndPoint=construct_point_131)
ln_216 = Line(StartPoint=pt_116, EndPoint=pt_117)
ln_217 = Line(StartPoint=pt_117, EndPoint=construct_point_135)
ln_218 = Line(StartPoint=pt_118, EndPoint=pt_115)
ln_219 = Line(StartPoint=pt_118, EndPoint=construct_point_58)
ln_220 = Line(StartPoint=pt_116, EndPoint=construct_point_51)
ln_221 = Line(StartPoint=pt_117, EndPoint=construct_point_140)
ln_222 = Line(StartPoint=pt_115, EndPoint=construct_point_143)
ln_223 = Line(StartPoint=construct_point_65, EndPoint=pt_118)
ln_224 = Line(StartPoint=construct_point_67, EndPoint=pt_116)
ln_225 = Line(StartPoint=pt_124, EndPoint=construct_point_52)
ln_226 = Line(StartPoint=pt_106, EndPoint=construct_point_56)
ln_227 = Line(StartPoint=pt_125, EndPoint=pt_106)
ln_228 = Line(StartPoint=pt_107, EndPoint=pt_124)
ln_229 = Line(StartPoint=pt_108, EndPoint=pt_125)
ln_230 = Line(StartPoint=pt_126, EndPoint=pt_107)
ln_231 = Line(StartPoint=pt_109, EndPoint=pt_126)
ln_232 = Line(StartPoint=pt_127, EndPoint=pt_108)
ln_233 = Line(StartPoint=pt_105, EndPoint=pt_127)
ln_234 = Line(StartPoint=pt_123, EndPoint=pt_109)
ln_235 = Line(StartPoint=pt_123, EndPoint=construct_point_27)
ln_236 = Line(StartPoint=pt_105, EndPoint=construct_point_38)
ln_237 = Line(StartPoint=construct_point_10, EndPoint=pt_128)
ln_238 = Line(StartPoint=pt_110, EndPoint=construct_point_14)
ln_239 = Line(StartPoint=pt_113, EndPoint=pt_130)
ln_240 = Line(StartPoint=pt_131, EndPoint=pt_112)
ln_241 = Line(StartPoint=pt_114, EndPoint=pt_131)
ln_242 = Line(StartPoint=pt_132, EndPoint=pt_113)
ln_243 = Line(StartPoint=pt_128, EndPoint=pt_114)
ln_244 = Line(StartPoint=pt_110, EndPoint=pt_132)
ln_245 = Line(StartPoint=pt_112, EndPoint=pt_129)
ln_246 = Line(StartPoint=pt_130, EndPoint=pt_111)
ln_247 = Line(StartPoint=pt_111, EndPoint=construct_point_65)
ln_248 = Line(StartPoint=construct_point_56, EndPoint=pt_129)
ln_249 = Line(StartPoint=pt_124, EndPoint=pt_130)
ln_250 = Line(StartPoint=construct_point_50, EndPoint=pt_129)
ln_251 = Line(StartPoint=pt_125, EndPoint=pt_131)
ln_252 = Line(StartPoint=construct_point_38, EndPoint=pt_128)
ln_253 = Line(StartPoint=construct_point_27, EndPoint=pt_110)
ln_254 = Line(StartPoint=pt_105, EndPoint=pt_114)
ln_255 = Line(StartPoint=pt_109, EndPoint=pt_113)
ln_256 = Line(StartPoint=pt_123, EndPoint=pt_132)
ln_257 = Line(StartPoint=pt_127, EndPoint=pt_131)
ln_258 = Line(StartPoint=pt_107, EndPoint=pt_113)
ln_259 = Line(StartPoint=pt_106, EndPoint=pt_112)
ln_260 = Line(StartPoint=construct_point_54, EndPoint=pt_111)
merge_2 = Merge(
    Data1=ln_205,
    Data2=ln_206,
    Data3=ln_207,
    Data4=ln_208,
    Data5=ln_209,
    Data6=ln_210,
    Data7=ln_211,
    Data8=ln_212,
    Data9=ln_213,
    Data10=ln_214,
    Data11=ln_215,
    Data12=ln_216,
    Data13=ln_217,
    Data14=ln_218,
    Data15=ln_219,
    Data16=ln_220,
    Data17=ln_221,
    Data18=ln_222,
    Data19=ln_223,
    Data20=ln_224)
pt_133 = ConstructPoint(XCoordinate=Slider(-25, range=-70..215), YCoordinate=Slider(65, range=-70..215), ZCoordinate=Slider(20, range=0..60))
pt_134 = ConstructPoint(XCoordinate=Slider(-25, range=-70..215), YCoordinate=Slider(175, range=-70..215), ZCoordinate=Slider(20, range=0..60))
pt_135 = ConstructPoint(XCoordinate=Slider(10, range=-70..215), YCoordinate=Slider(65, range=-70..215), ZCoordinate=Slider(20, range=0..60))
pt_136 = ConstructPoint(XCoordinate=Slider(10, range=-70..215), YCoordinate=Slider(175, range=-70..215), ZCoordinate=Slider(20, range=0..60))
ln_261 = Line(StartPoint=pt_133, EndPoint=construct_point_99)  # disabled
ln_262 = Line(StartPoint=pt_134, EndPoint=construct_point_133)  # disabled
ln_263 = Line(StartPoint=pt_133, EndPoint=construct_point_86)  # disabled
ln_264 = Line(StartPoint=pt_134, EndPoint=construct_point_123)  # disabled
ln_265 = Line(StartPoint=pt_133, EndPoint=pt_134)  # disabled
ln_266 = Line(StartPoint=pt_133, EndPoint=pt_135)  # disabled
ln_267 = Line(StartPoint=pt_134, EndPoint=pt_136)  # disabled
ln_268 = Line(StartPoint=pt_133, EndPoint=construct_point_2)  # disabled
ln_269 = Line(StartPoint=pt_134, EndPoint=construct_point_10)  # disabled

xz_2 = XZPlane(Origin="10,120")
mirror_4 = Mirror(Plane=xz_2)  # -> Geometry, Transform; disabled

xz_3 = XZPlane(Origin="10,120")
mirror_5 = Mirror(
    Geometry=[ln_225, ln_226, ln_227, ln_228, ln_229, ln_230, ln_231, ln_232, ln_233, ln_234, ln_249, ln_250, ln_251, ln_252, ln_235, ln_253, ln_236, ln_254, ln_255, ln_237, ln_256, ln_238, ln_257, ln_239, ln_258, ln_240, ln_259, ln_260, ln_241, ln_242, ln_243, ln_244, ln_245, ln_246, ln_247, ln_248, pt_106, pt_107, pt_108, pt_109, pt_105, pt_124, pt_125, pt_126, pt_127, pt_123, pt_111, pt_112, pt_113, pt_114, pt_110, pt_129, pt_130, pt_131, pt_132, pt_128, ln_205, ln_206, ln_207, ln_208, ln_209, ln_210, ln_211, ln_212, ln_213, ln_214, ln_215, ln_216, ln_217, ln_218, ln_219, ln_220, ln_221, ln_222, ln_223, ln_224, pt_119, pt_120, pt_121, pt_122, pt_115, pt_116, pt_117, pt_118],
    Plane=xz_3)  # -> Geometry, Transform

yz_2 = YZPlane(Origin="45,90")
mirror_6 = Mirror(
    Geometry=[ln_225, ln_226, ln_227, ln_228, ln_229, ln_230, ln_231, ln_232, ln_233, ln_234, ln_249, ln_250, ln_251, ln_252, ln_235, ln_253, ln_236, ln_254, ln_255, ln_237, ln_256, ln_238, ln_257, ln_239, ln_258, ln_240, ln_259, ln_260, ln_241, ln_242, ln_243, ln_244, ln_245, ln_246, ln_247, ln_248, pt_106, pt_107, pt_108, pt_109, pt_105, pt_124, pt_125, pt_126, pt_127, pt_123, pt_111, pt_112, pt_113, pt_114, pt_110, pt_129, pt_130, pt_131, pt_132, pt_128],
    Plane=yz_2)  # -> Geometry, Transform; disabled

yz_3 = YZPlane(Origin="-25,90")
mirror_7 = Mirror(
    Geometry=[ln_225, ln_226, ln_227, ln_228, ln_229, ln_230, ln_231, ln_232, ln_233, ln_234, ln_249, ln_250, ln_251, ln_252, ln_235, ln_253, ln_236, ln_254, ln_255, ln_237, ln_256, ln_238, ln_257, ln_239, ln_258, ln_240, ln_259, ln_260, ln_241, ln_242, ln_243, ln_244, ln_245, ln_246, ln_247, ln_248, pt_106, pt_107, pt_108, pt_109, pt_105, pt_124, pt_125, pt_126, pt_127, pt_123, pt_111, pt_112, pt_113, pt_114, pt_110, pt_129, pt_130, pt_131, pt_132, pt_128],
    Plane=yz_3)  # -> Geometry, Transform; disabled

yz_4 = YZPlane(Origin="10,120")
mirror_8 = Mirror(Geometry=merge_2, Plane=yz_4)  # -> Geometry, Transform

xz_4 = XZPlane(Origin="10,175")
mirror_9 = Mirror(Geometry=[merge_2, pt_119, pt_120, pt_121, pt_122, pt_115, pt_116, pt_117, pt_118], Plane=xz_4)  # -> Geometry, Transform

yz_5 = YZPlane(Origin="10,120")
mirror_10 = Mirror(Geometry=mirror_9.Geometry, Plane=yz_5)  # -> Geometry, Transform

xz_5 = XZPlane(Origin="60,120")
mirror_11 = Mirror(Geometry=mirror_8.Geometry, Plane=xz_5)  # -> Geometry, Transform

yz_6 = YZPlane(Origin="10,0")
mirror_12 = Mirror(
    Geometry=[ln_133, ln_134, ln_135, ln_136, ln_137, ln_138, ln_139, ln_140, ln_181, ln_141, ln_142, ln_143, ln_182, ln_183, ln_184, ln_185, ln_186, ln_144, ln_187, ln_145, ln_146, ln_188, ln_189, ln_147, ln_190, ln_191, ln_148, ln_192, ln_149, ln_150, ln_151, ln_152, ln_153, ln_154, ln_155, ln_156, ln_60, ln_59, ln_58, ln_57, ln_56, ln_55, ln_54, ln_53, ln_52, ln_51, ln_50, ln_49, ln_48, ln_47, ln_44, ln_45, ln_46, ln_43, ln_42, ln_41, line_294, line_293, line_292, line_291, line_312, line_311, line_310, line_309, line_308, line_307, line_306, line_305, line_304, line_303, line_302, line_301, line_300, line_299, line_298, line_297, line_296, line_295, line_271, line_272, line_273, line_274, ln_20, ln_19, ln_18, ln_17, ln_16, ln_15, ln_14, ln_13, ln_12, ln_11, ln_10, ln_9, ln_8, ln_7, ln_6, ln_5, ln_4, ln_3, ln_2, ln, ln_84, ln_83, ln_82, ln_81, ln_80, ln_79, ln_78, ln_77, ln_120, ln_76, ln_75, ln_74, ln_73, ln_72, ln_71, ln_70, ln_69, ln_68, ln_67, ln_119, ln_118, ln_117, ln_116, ln_115, ln_114, ln_113, ln_112, ln_111, ln_110, ln_109, ln_66, ln_65, ln_64, ln_63, ln_62, ln_61, ln_21, ln_22, ln_23, ln_24, ln_25, ln_26, ln_27, ln_28, ln_29, ln_30, ln_31, ln_32, ln_33, ln_34, ln_35, ln_36, ln_37, ln_38, ln_39, ln_40, line_210, line_209, line_208, line_207, line_246, line_245, line_244, line_243, line_242, line_241, line_234, line_233, line_232, line_231, line_230, line_229, line_228, line_227, line_226, line_225, line_224, line_223, line_182, line_181, line_180, line_179, line_163, line_164, line_165, line_166, line_211, line_212, line_213, line_214, line_215, line_216, line_217, line_218, line_219, line_220, line_221, line_222, line_202, line_201, line_200, line_199, line_240, line_239, line_238, line_237, line_236, line_235, ln_261, ln_262, ln_263, ln_264, ln_268, ln_269],
    Plane=yz_6)  # -> Geometry, Transform

multipipe = MultiPipe(
    Curves=[line_17, line_223, line_18, line_19, line_224, line_20, line_225, line_226, line_61, line_227, line_62, line_228, line_63, line_179, line_64, line_180, line_66, line_181, line_67, line_68, line_69, line_70, line_71, line_72, line_182, line_229, line_230, line_231, line_232, line_65, line_233, line_79, line_80, line_81, line_82, line_83, line_84, line_234, line_241, line_242, line_243, line_244, line_245, line_246, line_45, line_46, line_47, line_207, line_208, line_48, line_209, line_210, ln_21, ln_22, ln_23, ln_24, ln_25, ln_26, ln_27, ln_28, ln_29, ln_30, ln_31, ln_32, ln_33, ln_34, ln_35, ln_36, ln_37, ln_38, ln_39, ln_40, line, line_2, line_3, line_4, line_49, line_50, line_51, line_52, line_53, line_54, line_163, line_164, line_165, line_166, line_211, line_212, line_213, line_214, line_215, line_216, line_55, line_56, line_57, line_58, line_59, line_60, line_217, line_218, line_219, line_220, line_221, line_222, line_73, line_74, line_75, line_76, line_77, line_78, line_37, line_38, line_39, line_40, line_235, line_236, line_237, line_238, line_239, line_240, line_199, line_200, line_201, line_202, ln, ln_2, ln_3, ln_4, ln_5, ln_6, ln_7, ln_8, ln_9, ln_10, ln_11, ln_12, ln_13, ln_14, ln_15, ln_16, ln_17, ln_18, ln_19, ln_20, ln_61, ln_62, ln_63, ln_64, ln_65, ln_66, ln_67, ln_68, ln_69, ln_70, ln_71, ln_72, ln_73, ln_74, ln_75, ln_76, ln_77, ln_78, ln_79, ln_80, ln_81, ln_82, ln_83, ln_84, ln_120, ln_119, ln_118, ln_117, ln_116, ln_115, ln_114, ln_113, ln_112, ln_111, ln_110, ln_109, ln_85, ln_86, ln_87, ln_88, ln_89, ln_90, ln_91, ln_121, ln_122, ln_123, ln_92, ln_93, ln_124, ln_94, ln_95, ln_125, ln_96, ln_126, ln_97, ln_127, ln_128, ln_129, ln_98, ln_99, ln_130, ln_131, ln_132, ln_102, ln_103, ln_104, ln_105, ln_106, ln_107, ln_108, mirror_12.Geometry, ln_180, ln_179, ln_178, ln_177, ln_176, ln_175, ln_174, ln_173, ln_172, ln_171, ln_170, ln_169, ln_168, ln_204, ln_203, ln_202, ln_201, ln_200, ln_199, ln_167, ln_198, ln_197, ln_166, ln_196, ln_195, ln_194, ln_193, ln_165, ln_164, ln_163, ln_162, ln_161, ln_160, ln_159, ln_158, ln_157, ln_133, ln_134, ln_135, ln_136, ln_137, ln_138, ln_139, ln_140, ln_141, ln_142, ln_143, ln_144, ln_145, ln_181, ln_182, ln_183, ln_184, ln_185, ln_186, ln_187, ln_188, ln_189, ln_190, ln_146, ln_147, ln_148, ln_191, ln_192, ln_150, ln_149, ln_151, ln_152, ln_153, ln_154, ln_155, ln_156, ln_41, ln_42, ln_43, ln_44, ln_45, ln_46, ln_47, ln_48, ln_49, ln_50, ln_51, ln_52, ln_53, ln_54, ln_55, ln_56, ln_57, ln_58, ln_59, ln_60, line_294, line_293, line_292, line_291, line_312, line_311, line_310, line_309, line_308, line_307, line_306, line_305, line_304, line_303, line_302, line_301, line_271, line_272, line_273, line_274, line_295, line_296, line_297, line_298, line_299, line_300, line_109, line_110, line_111, line_112, line_133, line_134, line_135, line_136, line_137, line_138, line_139, line_140, line_141, line_142, line_143, line_144, line_145, line_146, line_147, line_148, line_149, line_150, line_132, line_131, line_130, line_129, ln_261, ln_262, ln_263, ln_264, ln_268, ln_269, ln_100, ln_101, mirror_5.Geometry, mirror_6.Geometry, mirror_7.Transform, mirror_7.Geometry, ln_225, ln_226, ln_227, ln_228, ln_229, ln_230, ln_231, ln_249, ln_232, ln_250, ln_233, ln_251, ln_234, ln_252, ln_253, ln_235, ln_254, ln_236, ln_255, ln_237, ln_256, ln_238, ln_257, ln_239, ln_258, ln_259, ln_260, ln_240, ln_241, ln_242, ln_243, ln_244, ln_245, ln_246, ln_247, ln_248, ln_205, ln_206, ln_207, ln_208, ln_209, ln_210, ln_211, ln_212, ln_213, ln_214, ln_215, ln_216, ln_217, ln_218, ln_219, ln_220, ln_221, ln_222, ln_223, ln_224, mirror_9.Geometry, mirror_8.Geometry, mirror_10.Geometry, mirror_11.Geometry, mirror_3.Geometry, mirror_2.Geometry, mirror.Geometry],
    NodeSize=Slider(0.5, range=0.1..5),
    EndOffset=1,
    StrutSize=1,
    Segment=0,
    KinkAngle=0.6,
    CubeFit=0,
    Caps=0)
colour_picker = ColourPicker(PickedColour=RGB(188, 201, 44))
custom_preview = CustomPreview(Geometry=multipipe, Material=colour_picker)

merge_3 = Merge(
    Data1=line_109,
    Data2=line_110,
    Data3=line_111,
    Data4=line_112,
    Data5=line_133,
    Data6=line_134,
    Data7=line_135,
    Data8=line_136,
    Data9=line_137,
    Data10=line_138,
    Data11=line_139,
    Data12=line_140,
    Data13=line_141,
    Data14=line_142,
    Data15=line_143,
    Data16=line_144,
    Data17=line_145,
    Data18=line_146,
    Data19=line_147,
    Data20=line_148,
    Data21=line_149,
    Data22=line_150,
    Data23=line_129,
    Data24=line_130,
    Data25=line_131,
    Data26=line_132,
    Data27=line_291,
    Data28=line_292,
    Data29=line_293,
    Data30=line_294,
    Data31=line_312,
    Data32=line_311,
    Data33=line_310,
    Data34=line_309,
    Data35=line_308,
    Data36=line_307,
    Data37=line_306,
    Data38=line_305,
    Data39=line_304,
    Data40=line_303,
    Data41=line_302,
    Data42=line_301,
    Data43=line_295,
    Data44=line_296,
    Data45=line_297,
    Data46=line_298,
    Data47=line_299,
    Data48=line_300,
    Data49=line_271,
    Data50=line_272,
    Data51=line_273,
    Data52=line_274,
    Data53=ln_41,
    Data54=ln_42,
    Data55=ln_43,
    Data56=ln_44,
    Data57=ln_45,
    Data58=ln_46,
    Data59=ln_47,
    Data60=ln_48,
    Data61=ln_49,
    Data62=ln_50,
    Data63=ln_51,
    Data64=ln_52,
    Data65=ln_53,
    Data66=ln_54,
    Data67=ln_55,
    Data68=ln_56,
    Data69=ln_57,
    Data70=ln_58,
    Data71=ln_59,
    Data72=ln_60,
    Data73=ln_157,
    Data74=ln_158,
    Data75=ln_159,
    Data76=ln_160,
    Data77=ln_161,
    Data78=ln_162,
    Data79=ln_163,
    Data80=ln_164,
    Data81=ln_165,
    Data82=ln_193,
    Data83=ln_194,
    Data84=ln_195,
    Data85=ln_166,
    Data86=ln_167,
    Data87=ln_196,
    Data88=ln_197,
    Data89=ln_168,
    Data90=ln_198,
    Data91=ln_199,
    Data92=ln_169,
    Data93=ln_200,
    Data94=ln_170,
    Data95=ln_201,
    Data96=ln_171,
    Data97=ln_202,
    Data98=ln_203,
    Data99=ln_204,
    Data100=ln_172,
    Data101=ln_173,
    Data102=ln_174,
    Data103=ln_175,
    Data104=ln_176,
    Data105=ln_177,
    Data106=ln_178,
    Data107=ln_179,
    Data108=ln_180,
    Data109=ln_133,
    Data110=ln_134,
    Data111=ln_135,
    Data112=ln_136,
    Data113=ln_137,
    Data114=ln_138,
    Data115=ln_139,
    Data116=ln_140,
    Data117=ln_141,
    Data118=ln_181,
    Data119=ln_182,
    Data120=ln_183,
    Data121=ln_184,
    Data122=ln_142,
    Data123=ln_185,
    Data124=ln_186,
    Data125=ln_187,
    Data126=ln_188,
    Data127=ln_189,
    Data128=ln_143,
    Data129=ln_144,
    Data130=ln_145,
    Data131=ln_146,
    Data132=ln_190,
    Data133=ln_191,
    Data134=ln_192,
    Data135=ln_147,
    Data136=ln_148,
    Data137=ln_149,
    Data138=ln_150,
    Data139=ln_151,
    Data140=ln_152,
    Data141=ln_153,
    Data142=ln_154,
    Data143=ln_155,
    Data144=ln_156,
    Data145=ln_225,
    Data146=ln_226,
    Data147=ln_227,
    Data148=ln_228,
    Data149=ln_229,
    Data150=ln_230,
    Data151=ln_231,
    Data152=ln_232,
    Data153=ln_249,
    Data154=ln_250,
    Data155=ln_251,
    Data156=ln_233,
    Data157=ln_234,
    Data158=ln_252,
    Data159=ln_253,
    Data160=ln_254,
    Data161=ln_255,
    Data162=ln_256,
    Data163=ln_235,
    Data164=ln_236,
    Data165=ln_237,
    Data166=ln_257,
    Data167=ln_258,
    Data168=ln_259,
    Data169=ln_260,
    Data170=ln_238,
    Data171=ln_239,
    Data172=ln_240,
    Data173=ln_241,
    Data174=ln_242,
    Data175=ln_243,
    Data176=ln_244,
    Data177=ln_245,
    Data178=ln_246,
    Data179=ln_247,
    Data180=ln_248,
    Data181=merge_2,
    Data183=ln,
    Data184=ln_2,
    Data185=ln_3,
    Data186=ln_4,
    Data187=ln_5,
    Data188=ln_6,
    Data189=ln_7,
    Data190=ln_8,
    Data191=ln_9,
    Data192=ln_10,
    Data193=ln_11,
    Data194=ln_12,
    Data195=ln_13,
    Data196=ln_14,
    Data197=ln_15,
    Data198=ln_16,
    Data199=ln_17,
    Data200=ln_18,
    Data201=ln_19,
    Data202=ln_20)
merge_4 = Merge(
    Data1=construct_point_65,
    Data2=construct_point_67,
    Data3=construct_point_69,
    Data4=construct_point_71,
    Data5=construct_point_66,
    Data6=construct_point_70,
    Data7=construct_point_68,
    Data8=construct_point_72,
    Data9=construct_point_64,
    Data10=construct_point_56,
    Data11=construct_point_60,
    Data12=construct_point_52,
    Data13=construct_point_63,
    Data14=construct_point_59,
    Data15=construct_point_55,
    Data16=construct_point_51,
    Data17=construct_point_62,
    Data18=construct_point_54,
    Data19=construct_point_58,
    Data20=construct_point_50,
    Data21=construct_point_125,
    Data22=construct_point_128,
    Data23=construct_point_129,
    Data24=construct_point_134,
    Data25=construct_point_126,
    Data26=construct_point_130,
    Data27=construct_point_131,
    Data28=construct_point_135,
    Data29=construct_point_127,
    Data30=construct_point_132,
    Data31=construct_point_133,
    Data32=construct_point_136,
    Data33=construct_point_137,
    Data34=construct_point_139,
    Data35=construct_point_140,
    Data36=construct_point_143,
    Data37=construct_point_138,
    Data38=construct_point_141,
    Data39=construct_point_142,
    Data40=construct_point_144,
    Data41=construct_point_114,
    Data42=construct_point_117,
    Data43=construct_point_118,
    Data44=construct_point_120,
    Data45=construct_point_112,
    Data46=construct_point_109,
    Data47=construct_point_108,
    Data48=construct_point_103,
    Data49=construct_point_102,
    Data50=construct_point_106,
    Data51=construct_point_107,
    Data52=construct_point_111,
    Data53=construct_point_101,
    Data54=construct_point_104,
    Data55=construct_point_105,
    Data56=construct_point_110,
    Data57=construct_point_2,
    Data58=construct_point_10,
    Data59=construct_point_6,
    Data60=construct_point_14,
    Data61=construct_point_4,
    Data62=construct_point_7,
    Data63=construct_point_11,
    Data64=construct_point_15,
    Data65=construct_point_3,
    Data66=construct_point_12,
    Data67=construct_point_8,
    Data68=construct_point_16,
    Data69=construct_point_22,
    Data70=construct_point_27,
    Data71=construct_point_33,
    Data72=construct_point_38,
    Data73=construct_point_21,
    Data74=construct_point_34,
    Data75=construct_point_28,
    Data76=construct_point_40)
merge_5 = Merge(
    Data1=construct_point,
    Data2=construct_point_5,
    Data3=construct_point_9,
    Data4=construct_point_13,
    Data5=construct_point_73,
    Data6=construct_point_74,
    Data7=construct_point_75,
    Data8=construct_point_76,
    Data9=construct_point_49,
    Data10=construct_point_53,
    Data11=construct_point_57,
    Data12=construct_point_61,
    Data13=construct_point_121,
    Data14=construct_point_122,
    Data15=construct_point_123,
    Data16=construct_point_124)

truss = LengthLine(Strength=Slider(2427, range=10..5000))

base_points = Anchor(Point=merge_5, Strength=10000)
joists = Anchor(Point=merge_4, Strength=10000)
load = Load(Point=joists, ForceVector="0,0,-9.81", Weighting=1)
merge_6 = Merge(Data1=base_points, Data2=truss, Data3=load)
panel = Panel(joists)
solver = Solver(GoalObjects=merge_6, Reset=False, Threshold=1e-15, Tolerance=Slider(0.001, range=0.001..0.01), On=Toggle(False))  # -> I, V, O
